# Grasshopper definition Mesh_to_Json.ghx (Grasshopper 1.0.7)

panel = Panel("C:\Users\eleni\Documents\GitHub\IntuitiveRobotics-AugmentedTechnologies\HandTracking\data")
mesh = Mesh(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)
dict_from_mesh = GhPythonScript(mesh=mesh, name="Log_1")  # -> data; inputs mesh: Mesh
# ---------- dict_from_mesh: Python ----------
import Rhino.Geometry as rg

data ={}
data["name"] = name

list_faces =[]
for f in mesh.Faces:
    face = [f[0], f[1], f[2]]
    list_faces.append(face)
data["faces"] = list_faces

list_vertices =[]
for v in mesh.Vertices:
    vertex=[v.X, v.Y, v.Z]
    list_vertices.append(vertex)
data["vertices"] = list_vertices

list_normals =[]
for n in mesh.Normals:
    normal=[n.X, n.Y, n.Z]
    list_normals.append(normal)
data["normals"] = list_normals

list_uv =[]
for u in mesh.TextureCoordinates:
    uv=[u.X, u.Y]
    list_uv.append(uv)
data["uv"] = list_uv

print data["faces"][2], data["vertices"][1] 
print data["normals"][20]
print data["uv"][20]

data =[data]
# ---------- end dict_from_mesh ----------
to_json = ToJSON(data=dict_from_mesh, folder_filepath=panel, file_name="Log_1", pretty=Toggle(True))  # -> json; inputs pretty: Boolean
#   port data: COMPAS data objects to serialize.
#   port folder_filepath: File path where to store the JSON file. If empty, it will not store to disk but instead return the JSON string.
#   port pretty: If True, JSON data will be formatted with indentation and key sorting.
#   port json: JSON file path or JSON string.
# ---------- to_json: Python ----------
"""
Serializes COMPAS objects to JSON.
"""

from ghpythonlib.componentbase import executingcomponent as component

import compas


class CompasInfo(component):
    def RunScript(self, data, folder_filepath, file_name, pretty):
        filepath = folder_filepath + "/" + file_name + ".json"
        json = filepath

        if filepath:
            compas.json_dump(data, filepath, pretty)
        else:
            json = compas.json_dumps(data, pretty)

        return json
# ---------- end to_json ----------
