# Grasshopper definition BendPieces.ghx (Grasshopper 1.0.7)
# plug-ins: Python, GhPython Script

arc_sed = ArcSED()  # -> Arc, Plane, Radius
polyline = PolyLine(
    Vertices=[Point(6.499136562, -0.371056174, 0), Point(7.238399515, -0.371056174, 0), Point(7.87540277, -0.371056174, 0), Point(9.591342702, -0.371056174, 0), Point(9.999871188, -0.371056174, 0), Point(11.30560761, -0.371056174, 0), Point(11.69774061, -0.371056174, 0)],
    Closed=False)
width = Slider(0.2, range=0..1)
height = Slider(0.16, range=0..1)
bend = Slider(0.62, range=0..0.99)
panel = Panel("""0
2
1
2
1
0""")
inside = BooleanToggle(True)
explode = Explode(Curve=polyline, Recursive=True)  # -> Segments, Vertices
bend_segment = GhPythonScript(index=Slider(2, range=0..5), bend_value=bend, inside=inside)  # -> out, arc, pts, bentPiece, vectors; inputs index: Int32, inside: Boolean
# ---------- bend_segment: Python ----------
import Rhino.Geometry as rg
import math

from scriptcontext import sticky as st

def align_arc_with_vector(arc, v, end_pt = None, tangent=None):
    if tangent==None:
        crv = arc.ToNurbsCurve()
        crv.Domain = rg.Interval(0, 1)

        # Calculate the tangent at the start of the arc
        tangent = crv.TangentAt(0)
    else:
        
        crv = arc
    # Calculate the angle between the tangent and the target vector
    angle = rg.Vector3d.VectorAngle(v, tangent)
    if end_pt ==None:
         end_pt = crv.PointAt(0)
         
    cross_product = rg.Vector3d.CrossProduct(v, tangent)
    if cross_product.Z > 0:
        angle = -angle

    # Set up the rotation transformation
    rotation = rg.Transform.Rotation(angle, rg.Vector3d.ZAxis, end_pt)
    
    crv.Transform(rotation)

    return crv


def remap(value, from_min, from_max, to_min, to_max):
    # Map 'value' from range [from_min, from_max] to range [to_min, to_max]
    from_range = from_max - from_min
    to_range = to_max - to_min
    scaled_value = (value - from_min) / from_range  # Normalize to [0, 1] in the from range
    return to_min + (scaled_value * to_range)

def compute_arc(A, B, s, side):
    # Compute chord length c
    D = B - A
    c = D.Length
    ln = False
    u = D / c
    if c >= s:
        print("Chord length is greater than or equal to arc length. No solution.")
        C = A + u * s
        line = rg.Line(A, C)
        ln = True 
        return line

    a = c / s

    # Function to find root: f(x) = sin(x) - a x
    def f(x):
        return math.sin(x) - a * x

    # Bisection method to solve sin(x) = a x
    x_low = 1e-6
    x_high = math.pi / 2.0 - 1e-6

    # Check that f(x_low) and f(x_high) have opposite signs
    if f(x_low) * f(x_high) > 0:
        print("No solution found in the interval.")
        return None

    # Tolerance and iteration limit
    tol = 1e-10
    max_iter = 100
    iter_count = 0

    while (x_high - x_low) > tol and iter_count < max_iter:
        x_mid = (x_low + x_high) / 2.0
        f_mid = f(x_mid)
        if f_mid == 0:
            x = x_mid
            break
        elif f(x_low) * f_mid < 0:
            x_high = x_mid
        else:
            x_low = x_mid
        iter_count += 1
    x = (x_low + x_high) / 2.0

    # Now compute radius r
    r = s / (2 * x)

    # Compute distance from midpoint to center
    d = math.sqrt(r ** 2 - (c / 2.0) ** 2)

    # Compute midpoint M
    M = rg.Point3d((A.X + B.X) / 2.0, (A.Y + B.Y) / 2.0, (A.Z + B.Z) / 2.0)

    # Unit vector along chord
    u = D / c

    # Normal vector to chord
    n = rg.Vector3d.CrossProduct(u, rg.Vector3d(0, 0, 1))
    n.Unitize()

    # Determine the center based on the side parameter
    if side:
        # Arc on the positive side (positive y-axis direction)
        C = M + n * d
    else:
        # Arc on the negative side (negative y-axis direction)
        C = M - n * d

    # Compute angle θ = 2x
    theta = 2 * x

    # Create circle
    circle = rg.Circle(C, r)

    # Compute start and end angles for the arc
    angle_start = math.atan2(A.Y - C.Y, A.X - C.X)
    angle_end = angle_start + theta

    # Create arc using an interval of angles
    angle_interval = rg.Interval(angle_start, angle_end)
    arc = rg.Arc(circle, angle_interval)

    # Verify if arc ends at B; if not, reverse the sweep direction
    if (arc.EndPoint - B).Length >= 1e-6:
        angle_end = angle_start - theta
        angle_interval = rg.Interval(angle_start, angle_end)
        arc = rg.Arc(circle, angle_interval)

    return arc, ln

def translate_geometry(geometry, from_point, to_point):
    # Calculate the translation vector
    translation_vector = to_point - from_point

    # Create the translation transform
    translation_transform = rg.Transform.Translation(translation_vector)

    # Apply the translation to the geometry
    geometry.Transform(translation_transform)

    return geometry


bentPiece =[]
types = st["types"]
segments  = st["initial_geo"]
if not types[index] ==1:
    print "We can not bend this part"
    
else:
    segment = segments[index]
    start_pt= segment.PointAt(0)
    end_pt = segment.PointAt(1)
    
    tangent = segment.Direction
    tangent.Unitize()
    
    dmax = segment.Length
    
    value = remap(bend_value, 0, 1, 0, dmax -(2*dmax / math.pi))
    end_pt_tr = end_pt + (-tangent * value)
    
    arc, ln = compute_arc(start_pt, end_pt_tr, dmax, inside)
    
    if ln:
        arc = segment
        
    st["bent_geo"][index] = arc

bent_cnt = len(st["bent_geo"])

pts = []
for i in range(0, bent_cnt):
    segment = st["bent_geo"][i]
    if i <index or i==0:
        st["bent_geo"][i] = segment
        bentPiece.append(segment)
        continue
    if isinstance(segment, rg.Line):
        start_pt = segment.PointAt(0)
        tangent = segment.Direction
        tangent.Unitize()
    elif isinstance(segment, rg.Arc):
        crv = segment.ToNurbsCurve()
        crv.Domain = rg.Interval(0, 1)
        start_pt = crv.PointAt(0)
        tangent =crv.TangentAt(0)
    
    segment_prev = st["bent_geo"][i-1]
    if isinstance(segment_prev, rg.Line):
        end_pt_prev = segment_prev.PointAt(1)
        v = segment_prev.Direction
        v.Unitize()
    elif isinstance(segment_prev, rg.Arc):
        crv = segment_prev.ToNurbsCurve()
        crv.Domain = rg.Interval(0, 1)
        end_pt_prev = crv.PointAt(1)
        v =crv.TangentAt(1)
        
    segment = translate_geometry(segment, start_pt, end_pt_prev)
    segment = align_arc_with_vector(segment, v,end_pt_prev, tangent)
    st["bent_geo"][i] = segment
    bentPiece.append(segment)
# ---------- end bend_segment ----------
sticky = GhPythonScript(segments=explode.Segments, types=panel)  # -> out; inputs segments: list of Line, types: list of Int32
# ---------- sticky: Python ----------
from scriptcontext import sticky as st

st.clear()

key = "initial_geo"
st[key]= segments
key_types = "types"
st[key_types]= types
key_bent = "bent_geo"
st[key_bent]= []

for seg in segments:
    print seg
    st[key_bent].append(seg)
# ---------- end sticky ----------
panel_2 = Panel(bend_segment.out)
number_slider = Slider(3.176, range=0..5)
cluster = Cluster(curve=bend_segment.bentPiece, distance=width, value=width, factor=height, types=panel)  # -> flatten(brep), colors
construct_point = ConstructPoint(XCoordinate=0, YCoordinate=0, ZCoordinate=0)
cluster_2 = Cluster(curve=explode.Segments, distance=width, value=width, factor=height, types=panel)  # -> flatten(brep), colors
preview = CustomPreview(Geometry=cluster.brep, Material=cluster.colors)
unit_x = UnitX(Factor=number_slider)
preview_2 = CustomPreview(Geometry=cluster_2.brep, Material=cluster_2.colors)
move = Move(Geometry=construct_point, Motion=unit_x)  # -> Geometry, Transform
ghpython_script = GhPythonScript(start_pt=construct_point, end_pt=move.Geometry, d=number_slider, L="5")  # -> out, R, theta, midpoint; inputs start_pt: Point3d, end_pt: Point3d
# ---------- ghpython_script: Python ----------
import math
import Rhino.Geometry as rg

def find_radius(d, L, tolerance=1e-6, max_iterations=100):
    # Initial guess for R
    R = L / math.pi  # Start with an approximate radius

    # Newton's method iteration
    for i in range(max_iterations):
        # Compute the current function value and its derivative
        f_R = 2 * R * math.sin(L / (2 * R)) - d
        f_prime_R = 2 * math.sin(L / (2 * R)) - (L * math.cos(L / (2 * R))) / R
        
        # Update R using Newton's method
        if abs(f_prime_R) > 1e-10:  # Avoid division by zero
            R_new = R - f_R / f_prime_R
        else:
            return None  # No solution

        # Check for convergence
        if abs(R_new - R) < tolerance:
            return R_new
        
        R = R_new  # Update R for the next iteration

    return None  # If not converged

def arc_midpoint(P1, P2, R):
    # Extract coordinates from points
    x1 = P1.X
    y1 = P1.Y
    x2 = P2.X
    y2 = P2.Y

    # Calculate chord midpoint
    mx = (x1 + x2) / 2
    my = (y1 + y2) / 2

    # Calculate the chord length and central angle
    d = math.sqrt((x2 - x1)**2 + (y2 - y1)**2)
    theta = 2 * math.asin(d / (2 * R))

    # Calculate the direction vector perpendicular to the chord
    dx, dy = x2 - x1, y2 - y1
    perp_dx, perp_dy = -dy, dx  # Perpendicular vector

    # Normalize perpendicular vector
    length = math.sqrt(perp_dx**2 + perp_dy**2)
    perp_dx /= length
    perp_dy /= length

    # Calculate the distance from the midpoint to the arc midpoint
    distance_to_arc_midpoint = R * math.cos(theta / 2)

    # Calculate the arc midpoint
    cx = mx + perp_dx * distance_to_arc_midpoint
    cy = my + perp_dy * distance_to_arc_midpoint

    # Return the central angle and arc midpoint coordinates
    return theta, rg.Point3d(cx, cy, 0)


# Assuming start_pt and end_pt are defined as rg.Point3d objects in Grasshopper
R = find_radius(d, L)
if R is None:
    print("Could not find a valid radius for the given arc length and chord.")
else:
    theta, midpoint = arc_midpoint(start_pt, end_pt, R)
    print("Radius:", R)
    print("Central Angle (radians):", theta)
    print("Arc Midpoint:", midpoint)
# ---------- end ghpython_script ----------
panel_3 = Panel(ghpython_script.theta)
ghpython_script_2 = GhPythonScript(A=construct_point, B=move.Geometry, dmax="5")  # -> out, a; inputs A: Point3d, B: Point3d
# ---------- ghpython_script_2: Python ----------
import Rhino.Geometry as rg
import math

def compute_arc(A, B, s):
    # Compute chord length c
    D = B - A
    c = D.Length
    if c >= s:
        print("Chord length is greater than or equal to arc length. No solution.")
        return None

    a = c / s

    # Function to find root: f(x) = sin(x) - a x
    def f(x):
        return math.sin(x) - a * x

    # Bisection method to solve sin(x) = a x
    x_low = 1e-6
    x_high = math.pi / 2.0 - 1e-6

    # Check that f(x_low) and f(x_high) have opposite signs
    if f(x_low) * f(x_high) > 0:
        print("No solution found in the interval.")
        return None

    # Tolerance and iteration limit
    tol = 1e-10
    max_iter = 100
    iter_count = 0

    while (x_high - x_low) > tol and iter_count < max_iter:
        x_mid = (x_low + x_high) / 2.0
        f_mid = f(x_mid)
        if f_mid == 0:
            x = x_mid
            break
        elif f(x_low) * f_mid < 0:
            x_high = x_mid
        else:
            x_low = x_mid
        iter_count += 1
    x = (x_low + x_high) / 2.0

    # Now compute radius r
    r = s / (2 * x)

    # Compute distance from midpoint to center
    d = math.sqrt(r ** 2 - (c / 2.0) ** 2)

    # Compute midpoint M
    M = rg.Point3d((A.X + B.X) / 2.0, (A.Y + B.Y) / 2.0, (A.Z + B.Z) / 2.0)

    # Unit vector along chord
    u = D / c

    # Normal vector to chord (assuming Z axis is up)
    n = rg.Vector3d.CrossProduct(u, rg.Vector3d(0, 0, 1))
    n.Unitize()

    # Possible centers
    C1 = M + n * d
    C2 = M - n * d

    # Compute angle θ = 2x
    theta = 2 * x

    # For each center, create arc
    arcs = []
    for C in [C1, C2]:
        # Create circle
        circle = rg.Circle(C, r)

        # Compute start and end angles
        angle_start = math.atan2(A.Y - C.Y, A.X - C.X)
        angle_end = angle_start + theta

        # Create arc using an interval of angles
        angle_interval = rg.Interval(angle_start, angle_end)
        arc = rg.Arc(circle, angle_interval)

        # Check if arc ends at B
        if (arc.EndPoint - B).Length < 1e-6:
            arcs.append(arc)
        else:
            # Try negative sweep angle
            angle_end = angle_start - theta
            angle_interval = rg.Interval(angle_start, angle_end)
            arc = rg.Arc(circle, angle_interval)
            if (arc.EndPoint - B).Length < 1e-6:
                arcs.append(arc)
    if len(arcs) == 0:
        print("No arc found that ends at B.")
        return None
    else:
        # Return the first valid arc
        return arcs[0]

# Inputs: A (Point3d), B (Point3d), dmax (float)
arc = compute_arc(A, B, dmax)

# Output the arc
if arc:
    a = arc  # 'a' is the output variable in Grasshopper
else:
    a = None
# ---------- end ghpython_script_2 ----------
line = Line(StartPoint=construct_point, EndPoint=move.Geometry)
arc_3pt = Arc3Pt()  # -> Arc, Plane, Radius
length = Length(Curve=ghpython_script_2.a)
panel_4 = Panel(ghpython_script_2.out)
arc_ser = ArcSER(Start=construct_point, End=move.Geometry, Radius=ghpython_script.R)  # -> Arc, Center
curve_middle = CurveMiddle(Curve=line)
arc_tangent = ArcTangent()
panel_5 = Panel(length)
length_2 = Length(Curve=arc_ser.Arc)
panel_6 = Panel(length_2)
curvature_graph = CurvatureGraph(Curve=arc_ser.Arc, Density=5, Scale=Slider(91, range=0..100))
construct_point_2 = ConstructPoint(XCoordinate=0, YCoordinate=0, ZCoordinate=0)
unit_x_2 = UnitX(Factor=Slider(4.165, range=0..5))
move_2 = Move(Geometry=construct_point_2, Motion=unit_x_2)  # -> Geometry, Transform
construct_point_3 = ConstructPoint(XCoordinate=0, YCoordinate=0, ZCoordinate=0)
unit_x_3 = UnitX(Factor=1)
vector = Vector(Vector(-0.6225962128, 1.067485409, 0))
ghpython_script_3 = GhPythonScript(A=construct_point_2, B=move_2.Geometry, inside=Toggle(True), dmax="5", v=unit_x_3)  # -> out, arc, vec, cen; inputs A: Point3d, B: Point3d, inside: Boolean
# ---------- ghpython_script_3: Python ----------
import Rhino.Geometry as rg
import math

def compute_arc(A, B, s, side):
    # Compute chord length c
    D = B - A
    c = D.Length
    ln = False
    u = D / c
    if c >= s:
        print("Chord length is greater than or equal to arc length. No solution.")
        C = A + u * s
        line = rg.Line(A, C)
        ln = True 
        return line

    a = c / s

    # Function to find root: f(x) = sin(x) - a x
    def f(x):
        return math.sin(x) - a * x

    # Bisection method to solve sin(x) = a x
    x_low = 1e-6
    x_high = math.pi / 2.0 - 1e-6

    # Check that f(x_low) and f(x_high) have opposite signs
    if f(x_low) * f(x_high) > 0:
        print("No solution found in the interval.")
        return None

    # Tolerance and iteration limit
    tol = 1e-10
    max_iter = 100
    iter_count = 0

    while (x_high - x_low) > tol and iter_count < max_iter:
        x_mid = (x_low + x_high) / 2.0
        f_mid = f(x_mid)
        if f_mid == 0:
            x = x_mid
            break
        elif f(x_low) * f_mid < 0:
            x_high = x_mid
        else:
            x_low = x_mid
        iter_count += 1
    x = (x_low + x_high) / 2.0

    # Now compute radius r
    r = s / (2 * x)

    # Compute distance from midpoint to center
    d = math.sqrt(r ** 2 - (c / 2.0) ** 2)

    # Compute midpoint M
    M = rg.Point3d((A.X + B.X) / 2.0, (A.Y + B.Y) / 2.0, (A.Z + B.Z) / 2.0)

    # Unit vector along chord
    u = D / c

    # Normal vector to chord
    n = rg.Vector3d.CrossProduct(u, rg.Vector3d(0, 0, 1))
    n.Unitize()

    # Determine the center based on the side parameter
    if side:
        # Arc on the positive side (positive y-axis direction)
        C = M + n * d
    else:
        # Arc on the negative side (negative y-axis direction)
        C = M - n * d

    # Compute angle θ = 2x
    theta = 2 * x

    # Create circle
    circle = rg.Circle(C, r)

    # Compute start and end angles for the arc
    angle_start = math.atan2(A.Y - C.Y, A.X - C.X)
    angle_end = angle_start + theta

    # Create arc using an interval of angles
    angle_interval = rg.Interval(angle_start, angle_end)
    arc = rg.Arc(circle, angle_interval)

    # Verify if arc ends at B; if not, reverse the sweep direction
    if (arc.EndPoint - B).Length >= 1e-6:
        angle_end = angle_start - theta
        angle_interval = rg.Interval(angle_start, angle_end)
        arc = rg.Arc(circle, angle_interval)

    return arc, ln


arc, ln = compute_arc(A, B, dmax, inside)

if not ln:
    crv = arc.ToNurbsCurve()
    crv.Domain = rg.Interval(0, 1)
    pass
    tangent = crv.TangentAt(0)
    angle =  rg.Vector3d.VectorAngle(v, tangent)
    print math.degrees(angle)
    
    cross_product = rg.Vector3d.CrossProduct(v, tangent)
    if cross_product.Z > 0:
        angle = -angle
    
    cen =  crv.PointAt(0)
    vec = crv.TangentAt(0)
    rotation = rg.Transform.Rotation(angle, rg.Vector3d.ZAxis, crv.PointAt(0))
#    
    crv.Transform(rotation)
    
    arc = crv
# Output the arc
#if arc:
#    a = arc  # 'a' is the output variable in Grasshopper
#else:
#    a = None
# ---------- end ghpython_script_3 ----------
vector_display = VectorDisplay(Anchor=construct_point_3, Vector=[unit_x_3, vector])
evaluate_curve = EvaluateCurve(Curve=reparameterize(ghpython_script_3.arc), Parameter="1")  # -> Point, Tangent, Angle
length_3 = Length(Curve=ghpython_script_3.arc)
vector_display_2 = VectorDisplay(Anchor=ghpython_script_3.cen, Vector=ghpython_script_3.vec)
amplitude = Amplitude(Vector=evaluate_curve.Tangent, Amplitude=Slider(0.85, range=0..10))
panel_7 = Panel(ghpython_script_3.out)
panel_8 = Panel(length_3)
move_3 = Move(Geometry=evaluate_curve.Point, Motion=amplitude)  # -> Geometry, Transform

# ==== cluster Cluster
value = ClusterInput()
_2_defect = ColourSwatch(SwatchColor=RGB(82, 135, 227))
_0_edges = ColourSwatch(SwatchColor=RGB(99, 135, 105))
_1_clear = ColourSwatch(SwatchColor=RGB(255, 239, 161))
types = ClusterInput()
negative = Negative(Value=value)
curve = ClusterInput()
distance = ClusterInput()
color_mapping = GhPythonScript(options=[_0_edges, _1_clear, _2_defect], types=types)  # -> out, colors; inputs options: list of Color, types: list of Int32
# ---------- color_mapping: Python ----------
colors=[]

for type in types:
    colors.append(options[type])
# ---------- end color_mapping ----------
factor = ClusterInput()
offset_curve = OffsetCurve(Curve=curve, Plane=PlaneXY(0, 0, 0), Distance=distance, BothSides=negative, Kinks=0, CapType=1)
unit_z = UnitZ(Factor=factor)
colors = ClusterOutput(color_mapping.colors)
extrude = Extrude(Base=offset_curve, Direction=unit_z)
cap_holes = CapHoles(Brep=extrude)
brep = ClusterOutput(cap_holes)
