# Grasshopper definition Mqtt-Communication_8.ghx (Grasshopper 1.0.8)
# plug-ins: RhinoCodePluginGH, Pufferfish

polyline = PolyLine(
    Vertices=[Point(6.499136562, -0.371056174, 0), Point(7.238399515, -0.371056174, 0), Point(7.87540277, -0.371056174, 0), Point(9.591342702, -0.371056174, 0), Point(9.999871188, -0.371056174, 0), Point(11.30560761, -0.371056174, 0), Point(11.69774061, -0.371056174, 0)],
    Closed=False)
bend = Slider(0.69, range=0.01..0.99)
width = Slider(0.2, range=0..1)
height = Slider(0.16, range=0..1)
panel = Panel("""0
2
1
2
1
0""")
explode = Explode(Curve=polyline, Recursive=True)  # -> Segments, Vertices
inside = BooleanToggle(True)
# ------------------------    Create Inventory    ------------------------
# Types: 0 = Irregular End
# 1 = Clear Area
# 2 = Defect Area
meshes = Mesh([<mesh referenced from the Rhino model> x9])
python_3_script = Python3Script(index=Slider(2, range=0..5), bend_value=bend, inside=inside)  # -> out, arc, pts, bentPiece, vectors; inputs index: Int32, bend_value: Double, inside: Boolean
# ---------- python_3_script: Python ----------
import Rhino.Geometry as rg
import math

from scriptcontext import sticky as st

def align_arc_with_vector(arc, v, end_pt = None, tangent=None):
    if tangent==None:
        crv = arc.ToNurbsCurve()
        crv.Domain = rg.Interval(0, 1)

        # Calculate the tangent at the start of the arc
        tangent = crv.TangentAt(0)
    else:
        
        crv = arc
    # Calculate the angle between the tangent and the target vector
    angle = rg.Vector3d.VectorAngle(v, tangent)
    if end_pt ==None:
         end_pt = crv.PointAt(0)
         
    cross_product = rg.Vector3d.CrossProduct(v, tangent)
    if cross_product.Z > 0:
        angle = -angle

    # Set up the rotation transformation
    rotation = rg.Transform.Rotation(angle, rg.Vector3d.ZAxis, end_pt)
    
    crv.Transform(rotation)

    return crv


def remap(value, from_min, from_max, to_min, to_max):
    # Map 'value' from range [from_min, from_max] to range [to_min, to_max]
    from_range = from_max - from_min
    to_range = to_max - to_min
    scaled_value = (value - from_min) / from_range  # Normalize to [0, 1] in the from range
    return to_min + (scaled_value * to_range)

def compute_arc(A, B, s, side):
    # Compute chord length c
    D = B - A
    c = D.Length
    ln = False
    u = D / c
    if c >= s:
        print("Chord length is greater than or equal to arc length. No solution.")
        C = A + u * s
        line = rg.Line(A, C)
        ln = True 
        return line

    a = c / s

    # Function to find root: f(x) = sin(x) - a x
    def f(x):
        return math.sin(x) - a * x

    # Bisection method to solve sin(x) = a x
    x_low = 1e-6
    x_high = math.pi / 2.0 - 1e-6

    # Check that f(x_low) and f(x_high) have opposite signs
    if f(x_low) * f(x_high) > 0:
        print("No solution found in the interval.")
        return None

    # Tolerance and iteration limit
    tol = 1e-10
    max_iter = 100
    iter_count = 0

    while (x_high - x_low) > tol and iter_count < max_iter:
        x_mid = (x_low + x_high) / 2.0
        f_mid = f(x_mid)
        if f_mid == 0:
            x = x_mid
            break
        elif f(x_low) * f_mid < 0:
            x_high = x_mid
        else:
            x_low = x_mid
        iter_count += 1
    x = (x_low + x_high) / 2.0

    # Now compute radius r
    r = s / (2 * x)

    # Compute distance from midpoint to center
    d = math.sqrt(r ** 2 - (c / 2.0) ** 2)

    # Compute midpoint M
    M = rg.Point3d((A.X + B.X) / 2.0, (A.Y + B.Y) / 2.0, (A.Z + B.Z) / 2.0)

    # Unit vector along chord
    u = D / c

    # Normal vector to chord
    n = rg.Vector3d.CrossProduct(u, rg.Vector3d(0, 0, 1))
    n.Unitize()

    # Determine the center based on the side parameter
    if side:
        # Arc on the positive side (positive y-axis direction)
        C = M + n * d
    else:
        # Arc on the negative side (negative y-axis direction)
        C = M - n * d

    # Compute angle θ = 2x
    theta = 2 * x

    # Create circle
    circle = rg.Circle(C, r)

    # Compute start and end angles for the arc
    angle_start = math.atan2(A.Y - C.Y, A.X - C.X)
    angle_end = angle_start + theta

    # Create arc using an interval of angles
    angle_interval = rg.Interval(angle_start, angle_end)
    arc = rg.Arc(circle, angle_interval)

    # Verify if arc ends at B; if not, reverse the sweep direction
    if (arc.EndPoint - B).Length >= 1e-6:
        angle_end = angle_start - theta
        angle_interval = rg.Interval(angle_start, angle_end)
        arc = rg.Arc(circle, angle_interval)

    return arc, ln

def translate_geometry(geometry, from_point, to_point):
    # Calculate the translation vector
    translation_vector = to_point - from_point

    # Create the translation transform
    translation_transform = rg.Transform.Translation(translation_vector)

    # Apply the translation to the geometry
    geometry.Transform(translation_transform)

    return geometry


bentPiece =[]
types = st["types"]
segments  = st["initial_geo"]
if not types[index] ==1:
    print ("We can not bend this part")
    
else:
    segment = segments[index]
    start_pt= segment.PointAt(0)
    end_pt = segment.PointAt(1)
    
    tangent = segment.Direction
    tangent.Unitize()
    
    dmax = segment.Length
    
    value = remap(bend_value, 0, 1, 0, dmax -(2*dmax / math.pi))
    end_pt_tr = end_pt + (-tangent * value)
    
    arc, ln = compute_arc(start_pt, end_pt_tr, dmax, inside)
    
    if ln:
        arc = segment
        
    st["bent_geo"][index] = arc

bent_cnt = len(st["bent_geo"])

pts = []
for i in range(0, bent_cnt):
    segment = st["bent_geo"][i]
    if i <index or i==0:
        st["bent_geo"][i] = segment
        bentPiece.append(segment)
        continue
    if isinstance(segment, rg.Line):
        start_pt = segment.PointAt(0)
        tangent = segment.Direction
        tangent.Unitize()
    elif isinstance(segment, rg.Arc):
        crv = segment.ToNurbsCurve()
        crv.Domain = rg.Interval(0, 1)
        start_pt = crv.PointAt(0)
        tangent =crv.TangentAt(0)
    
    segment_prev = st["bent_geo"][i-1]
    if isinstance(segment_prev, rg.Line):
        end_pt_prev = segment_prev.PointAt(1)
        v = segment_prev.Direction
        v.Unitize()
    elif isinstance(segment_prev, rg.Arc):
        crv = segment_prev.ToNurbsCurve()
        crv.Domain = rg.Interval(0, 1)
        end_pt_prev = crv.PointAt(1)
        v =crv.TangentAt(1)
        
    segment = translate_geometry(segment, start_pt, end_pt_prev)
    segment = align_arc_with_vector(segment, v,end_pt_prev, tangent)
    st["bent_geo"][i] = segment
    bentPiece.append(segment)
# ---------- end python_3_script ----------
types = Panel("""0
1
2
1
2
1
2
1
0""")
pieces = Panel(meshes)
python_3_script_2 = Python3Script(segments=explode.Segments, types=panel)  # -> out; inputs segments: list of Line, types: list of Int32
# ---------- python_3_script_2: Python ----------
from scriptcontext import sticky as st

st.clear()

key = "initial_geo"
st[key]= segments
key_types = "types"
st[key_types]= types
key_bent = "bent_geo"
st[key_bent]= []

for seg in segments:
    print (seg)
    st[key_bent].append(seg)
# ---------- end python_3_script_2 ----------
cluster = Cluster_2(curve=python_3_script.bentPiece, distance=width, value=width, factor=height, types=panel)  # -> flatten(brep), colors
panel_2 = Panel(python_3_script.out)
cluster_2 = Cluster_2(curve=explode.Segments, distance=width, value=width, factor=height, types=panel)  # -> flatten(brep), colors
dict_from_mesh = Python3Script(meshes=meshes, types=types)  # -> out, data; inputs meshes: list of Mesh, types: list of Int32
# ---------- dict_from_mesh: Python ----------
import Rhino.Geometry as rg
import math

data ={}
data["uid"] =""
data["seg_mesh"] ={}

overall_bbox = rg.BoundingBox.Empty

mesh_lengths = []

i=0
for mesh in meshes:
    # Get the bounding box of the current mesh
    bbox = mesh.GetBoundingBox(True)
    
    # Add the bounding box to the overall bounding box
    overall_bbox = rg.BoundingBox.Union(overall_bbox, bbox)
    
    # Calculate the length (longest dimension) for the current mesh
    mesh_length = max(bbox.Max.X - bbox.Min.X, bbox.Max.Y - bbox.Min.Y, bbox.Max.Z - bbox.Min.Z)
    mesh_lengths.append(round(mesh_length, 2))
    
    mesh_key = "mesh"+ str(i)
    data["seg_mesh"][mesh_key] ={}
    
    data["seg_mesh"][mesh_key]["type"] = types[i]
    list_faces =[]
    for f in mesh.Faces:
        face = [f[0], f[1], f[2]]
        list_faces.append(face)
    data["seg_mesh"][mesh_key]["faces"] = list_faces
    
    list_vertices =[]
    for v in mesh.Vertices:
        vertex=[v.X, v.Y, v.Z]
        list_vertices.append(vertex)
    data["seg_mesh"][mesh_key]["vertices"] = list_vertices
    
    list_normals =[]
    for n in mesh.Normals:
        normal=[n.X, n.Y, n.Z]
        list_normals.append(normal)
    data["seg_mesh"][mesh_key]["normals"] = list_normals
    
    i+=1

# Calculate the dimensions (width, length, height) of the overall bounding box
overall_width = float(round(overall_bbox.Max.X - overall_bbox.Min.X, 2 ))
overall_length = float(round( overall_bbox.Max.Y - overall_bbox.Min.Y, 2))
overall_height = float(round( overall_bbox.Max.Z - overall_bbox.Min.Z, 2 ))


data["dimensions"]={}
data["dimensions"]["width"] = overall_width
data["dimensions"]["length"] = overall_length
data["dimensions"]["height"] = overall_height

data=[data]
# ---------- end dict_from_mesh ----------

add = Button()
from_json = Python3Script(file_name="material_library")  # -> result, filepath
# ---------- from_json: Python ----------
"""
Serializes COMPAS objects to JSON.
"""

from ghpythonlib.componentbase import executingcomponent as component
import compas
import os
import scriptcontext as sc

class CompasInfo(component):
    def RunScript(self, file_name):
        gh_document = sc.doc
        base_folder = ""
        if gh_document:
            try:
                # Attempt to get the base folder path from the Grasshopper document's path
                base_folder = os.path.dirname(gh_document.Path)
            except AttributeError:
                # Handle cases where the document path cannot be determined
                print("Grasshopper document path could not be determined. Ensure this script is running from a saved Grasshopper file.")
                return None, None

        # Define the relative path to the 'data' folder
        data_folder_relative_path = os.path.join("..", "data")
        data_folder_path = os.path.abspath(os.path.join(base_folder, data_folder_relative_path))
        
        # Create the 'data' folder if it does not exist
        if not os.path.exists(data_folder_path):
            os.makedirs(data_folder_path)
        
        # Construct the file path inside the 'data' folder
        filepath = os.path.join(data_folder_path, file_name + ".json")
        print(filepath)

        # Check if the file exists before attempting to load
        if os.path.exists(filepath):
            try:
                data = compas.json_load(filepath)
            except Exception as e:
                print("Error loading JSON file:", e)
                data = None
        else:
            print("File does not exist:", filepath)
            data = None

        # Return the data and file path
        return [data], filepath
# ---------- end from_json ----------
replace = Button()
to_json = Python3Script(data=dict_from_mesh.data, filepath=from_json.filepath, element_id=Slider(0, range=0..50), add=add, replace=replace)  # -> json; inputs element_id: Int32, add: Boolean, replace: Boolean
# ---------- to_json: Python ----------
from ghpythonlib.componentbase import executingcomponent as component
import compas
import os
import Rhino
from System.Collections import IDictionary
from Grasshopper.Kernel.Types import IGH_Goo

class CompasInfo(component):
    def RunScript(self, data, filepath, element_id: int, add: bool, replace: bool):

        # Initialize self.library if it doesn't exist
        if not hasattr(self, 'library'):
            self.library = {'priority': [], 'priority_lengths': [], 'elements': {}}

        library = self.library  # Use self.library in the code

        json = filepath

        element_key = ""
        if replace:
            element_key = "element" + str(element_id)
        elif add:
            element_key = "element" + str(len(library["priority"]))

        # Check if the element already exists in the dictionary
        element_exists = element_key in library["elements"]

        if add or replace:
            # Unwrap the data before storing it
            unwrapped_data = self.unwrap_data(data)

            # If the element does not exist and add is True, add it to the dictionary
            if not element_exists and add:
                library["priority"].append(element_key)  # Add to priority list
                library["elements"][element_key] = unwrapped_data  # Add element data
                ghenv.Component.Message = "Element '{}' has been added.".format(element_key)
            elif element_exists and add:
                # If the element exists and add is True, throw an error
                ghenv.Component.Message = "Error: Element '{}' already exists.".format(element_key)
                ghenv.Component.AddRuntimeMessage(ghenv.Component.RuntimeMessageLevel.Error, ghenv.Component.Message)
            # If the element exists and replace is True, replace the element
            elif element_exists and replace:
                library["elements"][element_key] = unwrapped_data  # Replace the element data
                ghenv.Component.Message = "Element '{}' has been replaced.".format(element_key)
            elif not element_exists and replace:
                # If the element does not exist and replace is True, throw an error
                ghenv.Component.Message = "Error: Element '{}' does not exist.".format(element_key)
                ghenv.Component.AddRuntimeMessage(ghenv.Component.RuntimeMessageLevel.Error, ghenv.Component.Message)
        else:
            # Do nothing, maintain current library
            pass

        # Unwrap the entire library before serialization
        unwrapped_library = self.unwrap_data(library)

        # If filepath is provided, save the updated library to JSON
        if filepath:
            compas.json_dump(unwrapped_library, filepath, True)  # Save to the provided filepath
        else:
            json = compas.json_dumps(unwrapped_library, True)  # Return the json as a string

        # Update self.library to maintain state
        self.library = library

        return json

    def unwrap_data(self, data):
        # Unwrap GH_ObjectWrapper
        if hasattr(data, 'Value'):
            data = data.Value
        
        # Check for .NET IDictionary types
        if isinstance(data, IDictionary):
            new_data = {}
            for key in data.Keys:
                value = data[key]
                key = self.unwrap_data(key)
                value = self.unwrap_data(value)
                new_data[key] = value
            return new_data
        
        # Handle standard Python dictionaries
        elif isinstance(data, dict):
            new_data = {}
            for key, value in data.items():
                key = self.unwrap_data(key)
                value = self.unwrap_data(value)
                new_data[key] = value
            return new_data
        
        # Handle lists and other iterables
        elif hasattr(data, '__iter__') and not isinstance(data, str):
            return [self.unwrap_data(item) for item in data]
        
        # Unwrap IGH_Goo types
        elif isinstance(data, IGH_Goo):
            return self.unwrap_data(data.ScriptVariable())
        
        else:
            return data
# ---------- end to_json ----------

dict_from_mesh_2 = GhPythonScript(meshes=meshes, types=types)  # -> data; inputs meshes: list of Mesh, types: list of Int32; same code as dict_from_mesh
preview = CustomPreview(Geometry=cluster.brep, Material=cluster.colors)
preview_2 = CustomPreview(Geometry=cluster_2.brep, Material=cluster_2.colors)

triangulated_mesh = Mesh(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)

triangulated_mesh_2 = Mesh(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)

# ----
# 1. Add New Geometries
panel_3 = Panel("Log_Test")
# ------------------------    Send  Geo to Unity  (one at the time)   ------------------------
triangulated_mesh_3 = Mesh(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)
colour = ColourSwatch(SwatchColor=RGB(165, 105, 255))

triangulated_mesh_4 = Mesh(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)

# ----
# Notes: a) Use only triangulated Mesh
# b) Follow the pattern : Mesh/ Name/ Color for new entries
# c) Use unique names for each entry
panel_4 = Panel("")
triangulated_mesh_5 = Mesh(<mesh referenced from the Rhino model>)

# ----
# ------------------------    Send  Geos to Unity   ------------------------
triangulated_mesh_6 = Mesh(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)
colour_2 = ColourSwatch(SwatchColor=RGB(165, 105, 255))

triangulated_mesh_7 = Mesh(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)

triangulated_mesh_8 = Mesh(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)

triangulated_mesh_9 = Mesh(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)

colour_3 = ColourSwatch(SwatchColor=RGB(105, 255, 132))

colour_4 = ColourSwatch(SwatchColor=RGB(197, 184, 217))

colour_5 = ColourSwatch(SwatchColor=RGB(105, 255, 132))

colour_6 = ColourSwatch(SwatchColor=RGB(165, 105, 255))

colour_7 = ColourSwatch(SwatchColor=RGB(197, 184, 217))

colour_8 = ColourSwatch(SwatchColor=RGB(165, 105, 255))

colour_9 = ColourSwatch(SwatchColor=RGB(165, 105, 255))

# ----
# 1. Select Curves
curve = Curve([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])
# Notes: a) Add Curves ( Periodic or not)
# b) Give a name to the drawing
# c) The Color not working at the moment
number_slider = Slider(0, range=0..15)
curve_edit_points = CurveEditPoints(Curve=curve, Knots=True)  # -> Points, Tangents, Parameters
colour_10 = ColourSwatch(SwatchColor=RGB(165, 105, 255))
curvesdict = Python3Script(curves=curve, points=curve_edit_points.Points, drawingIndex=number_slider, name="roof", color=colour_10)  # -> data; inputs curves: list of Curve, points: tree of Point3d, drawingIndex: Int32, color: Color
# ---------- curvesdict: Python ----------
import ghpythonlib.treehelpers as th
import Rhino
import Grasshopper
import System


points = th.tree_to_list(points)

drawing_name = "drawingR" + str(drawingIndex)
data ={}
data["uid"] = name
data["drawings"] ={}
data["drawings"][drawing_name] ={}
data["drawings"][drawing_name]["lines"] ={}
data["drawings"][drawing_name]["scale"] = 1.0

print ("hey")    
i=0
for curve in curves:
    if curve!=None:
        data["drawings"][drawing_name]["lines"]["line"+str(i)] = {}
        data["drawings"][drawing_name]["lines"]["line"+str(i)]["periodic"] = curve.IsClosed
        data["drawings"][drawing_name]["lines"]["line"+str(i)]["color"] = [color.R/255, color.G/255, color.B/255, color.A/255 ]
        pts=[]
        for point in points[i]:
            pt = [point.X, point.Y, point.Z]
            pts.append(pt)
        data["drawings"][drawing_name]["lines"]["line"+str(i)]["positions"] =pts
        i+=1

data = [data]
# ---------- end curvesdict ----------

curvesdict_2 = Python3Script(curves=curve, points=curve_edit_points.Points, drawingIndex=number_slider, name="roof", color=colour_10)  # -> data; inputs curves: list of Curve, points: tree of Point3d, drawingIndex: Int32, color: Color
# ---------- curvesdict_2: Python ----------
import ghpythonlib.treehelpers as th
import Rhino
import Grasshopper
import System


class CurvesDict:
    
    def RunScript(self,
            curves: list[Rhino.Geometry.Curve],
            points: Grasshopper.DataTree[Rhino.Geometry.Point3d],
            drawingIndex: int,
            name,
            color: System.Drawing.Color):
        
        points = th.tree_to_list(points)

        drawing_name = "drawingR" + str(drawingIndex)
        data ={}
        data["uid"] = name
        data["drawings"] ={}
        data["drawings"][drawing_name] ={}
        data["drawings"][drawing_name]["lines"] ={}
        data["drawings"][drawing_name]["scale"] = 1.0

        print ("hey")    
        i=0
        for curve in curves:
            if curve!=None:
                data["drawings"][drawing_name]["lines"]["line"+str(i)] = {}
                data["drawings"][drawing_name]["lines"]["line"+str(i)]["periodic"] = curve.IsClosed
                data["drawings"][drawing_name]["lines"]["line"+str(i)]["color"] = [color.R/255, color.G/255, color.B/255, color.A/255 ]
                pts=[]
                for point in points[i]:
                    pt = [point.X, point.Y, point.Z]
                    pts.append(pt)
                data["drawings"][drawing_name]["lines"]["line"+str(i)]["positions"] =pts
                i+=1

        return data
# ---------- end curvesdict_2 ----------

# ----
# GLOBAL SETTINGS
# ------------------------    Send  Curves to Unity    ------------------------
host_name = Panel("localhost")
tablemenu_area = Rectangle({Plane=PlaneXY(0.2491139817, -0.0375, 0), Size=Domain2(u=-0.1312275416..0.1312275416, v=-0.0475..0.0475)})
ar_marker = ARMarker()

geometries = Merge(
    Data1=triangulated_mesh_3,
    Data2=panel_3,
    Data3=colour,
    Data4=triangulated_mesh_4,
    Data5="Cube",
    Data6=colour_4,
    Data7=triangulated_mesh,
    Data8="Cylinder",
    Data9=colour_3)

# ----
# 1. Add New Geometries
# Notes: a) Use only triangulated Mesh
# b) Follow the pattern : Mesh/ Name/ Color for new entries
# c) Use unique names for each entry
geometries_2 = Merge(
    Data1=triangulated_mesh_6,
    Data2="A",
    Data3=colour_2,
    Data4=triangulated_mesh_7,
    Data5="B",
    Data6=colour_7,
    Data7=triangulated_mesh_2,
    Data8="C",
    Data9=colour_5,
    Data10=triangulated_mesh_8,
    Data11="D",
    Data12=colour_8,
    Data13=triangulated_mesh_9,
    Data14="E",
    Data15=colour_9)

# ----
# 2. Select a Geometry
index = Slider(0, range=0..10)
# Notes: a) Increase the max value of the domain if needed
cluster_3 = Cluster(list=geometries, index=index)  # -> selectedname, geo, color, geodict

# ----
# 2. Select Geos
elements = Panel("""0
4
2
1""")
# Notes: a) Increase the max value of the domain if needed
cluster_4 = Cluster(list=geometries_2, index=elements)  # -> selectedname, geo, color, geodict

selectedname = Panel(cluster_3.selectedname)
visualize_geo = CustomPreview(SelectedGeo=cluster_3.geo, Material=ColourSwatch(SwatchColor=RGB(255, 255, 0)))  # disabled

selectedname_2 = Panel(cluster_4.selectedname)
visualize_geo_2 = CustomPreview(SelectedGeo=cluster_4.geo, Material=ColourSwatch(SwatchColor=RGB(255, 255, 0)))  # disabled

# ----
# 3. Pick your team
design_name = Panel("roof")
# 3. Pick your team
number_slider_2 = Slider(0, range=0..100)

# ----
# 2. Pick your team
value_list = ValueList({"Team A": 0, "Team B": 1}, selected="Team A")
ghpython_script = GhPythonScript(team=value_list)  # -> topicPublishGeo, topicPublishGeos, topicPublishLines, topicSubscribe; inputs team: Int32
# ---------- ghpython_script: Python ----------
if team ==0:
    topicPublishGeo ="/kitgkr_teamA_geometry/"
    topicPublishGeos ="/kitgkr_teamA_geometries/"
    topicPublishLines ="/kitgkr_teamA_lines/"
    topicSubscribe ="/kitgkr_teamA_drawings/"
elif team==1:
    topicPublishGeo ="/kitgkr_teamB_geometry/"
    topicPublishGeos ="/kitgkr_teamB_geometries/"
    topicPublishLines ="/kitgkr_teamB_lines/"
    topicSubscribe ="/kitgkr_teamB_drawings/"
# ---------- end ghpython_script ----------

value_list_2 = ValueList({"String": 0, "Integer Number": 1, "Floating Point Number": 2, "Boolean Value": 3, "Dictionary": 4, "List": 5}, selected="Integer Number")
mqtt_publisher = Python3Script(
    host=host_name,
    topic_name=ghpython_script.topicPublishLines,
    msg=number_slider_2,
    msg_type=value_list_2,
    send=Toggle(True))  # -> topic, is_advertised
# ---------- mqtt_publisher: Python ----------
import ast
import time
import compas
import json
from ghpythonlib.componentbase import executingcomponent as component
from scriptcontext import sticky as st
from threading import Event


from compas_eve import Message, Publisher, Subscriber, Topic, BinaryMessageCodec,  set_default_transport

from compas_eve.mqtt import MqttTransport
from compas_ghpython import create_id

# Import clr and .NET types
import clr
from System.Collections.Generic import IDictionary
from Grasshopper.Kernel.Types import IGH_Goo

class MQTTTopicPublish(component):
    
    def RunScript(self, host, topic_name, msg, msg_type, send):
        # Check for required inputs
        if not host:
            raise ValueError('Please specify host')
        if not topic_name:
            raise ValueError('Please specify the name of the topic')
        
        # Create a unique key for storing the topic in sticky
        key = create_id(ghenv.Component, 'mqtt_topic' + topic_name)
        topic = st.get(key, None)
        
        # Initialize MQTT transport with the specified host
        if host:
            tx = MqttTransport(host, codec =BinaryMessageCodec() )
            print (tx.codec)
            # Create the topic if it doesn't exist
            if not topic:
                topic = Topic(topic_name, Message)
                time.sleep(0.2)
                st[key] = topic
                
        self.is_advertised = topic
        
        # If msg is None, check if the topic is advertised
        if msg is None:
            if self.is_advertised:
                ghenv.Component.Message = 'Topic advertised'
                
        else:
            # Handle different message types
            if send:
                message = self.convert_msg(msg, msg_type)
                
                # Encode the message and publish it
                message_encoded = Message(result=message)
                Publisher(topic, transport=tx).publish(message_encoded)
                # Publisher(topic, transport=tx).publish(message)
                
                ghenv.Component.Message = 'Message published'

        return topic.name, self.is_advertised
        
    def convert_msg(self, msg, msg_type):
        if msg_type in [0, 1, 2, 5]:  # string, int, float, list
            return str(msg)
        elif msg_type == 3:  # bool
            return "True" if bool(msg) else "False"
        elif msg_type == 4:  # dict
            print(type(msg))  # Should output: <class 'dict'>
            # Unwrap the data
            unwrapped_msg = self.unwrap_data(msg)
            return compas.json_dumps(unwrapped_msg, False)
        else:
            print("other")
            return str(msg)
    
    def unwrap_data(self, data):
        # Unwrap GH_ObjectWrapper
        if hasattr(data, 'Value'):
            data = data.Value
        
        # Check for .NET IDictionary types
        if isinstance(data, IDictionary):
            new_data = {}
            for key in data.Keys:
                value = data[key]
                key = self.unwrap_data(key)
                value = self.unwrap_data(value)
                new_data[key] = value
            return new_data
        
        # Handle standard Python dictionaries
        elif isinstance(data, dict):
            new_data = {}
            for key, value in data.items():
                key = self.unwrap_data(key)
                value = self.unwrap_data(value)
                new_data[key] = value
            return new_data
        
        # Handle lists and other iterables
        elif hasattr(data, '__iter__') and not isinstance(data, str):
            return [self.unwrap_data(item) for item in data]
        
        # Unwrap IGH_Goo types
        elif isinstance(data, IGH_Goo):
            return self.unwrap_data(data.ScriptVariable())
        
        else:
            return data
# ---------- end mqtt_publisher ----------

panel_5 = Panel("4")

# ----
# Double click the Jump Knob
# 3. Send via MQTT
send = Button()

# ----
# Double click the Jump Knob
# 4. Send via MQTT
send_2 = Button()

value_list_3 = ValueList({"String": 0, "Integer Number": 1, "Floating Point Number": 2, "Boolean Value": 3, "Dictionary": 4, "List": 5}, selected="Dictionary")
dict_from_mesh_3 = Python3Script(name=cluster_3.selectedname, color=cluster_3.color, mesh=cluster_3.geo)  # -> data; inputs name: String, color: Color, mesh: Mesh
# ---------- dict_from_mesh_3: Python ----------
import Rhino.Geometry as rg

data ={}
data["name"] = name
data["color"] = [color.R/255, color.G/255, color.B/255, color.A/255 ]

list_faces =[]
for f in mesh.Faces:
    face = [f[0], f[1], f[2]]
    list_faces.append(face)
data["faces"] = list_faces

list_vertices =[]
for v in mesh.Vertices:
    vertex=[v.X, v.Y, v.Z]
    list_vertices.append(vertex)
data["vertices"] = list_vertices

list_normals =[]
for n in mesh.Normals:
    normal=[n.X, n.Y, n.Z]
    list_normals.append(normal)
data["normals"] = list_normals

list_uv =[]
for u in mesh.TextureCoordinates:
    uv=[u.X, u.Y]
    list_uv.append(uv)
data["uv"] = list_uv


data =[data]
# ---------- end dict_from_mesh_3 ----------
mqtt_publisher_2 = Python3Script(host=host_name, topic_name=ghpython_script.topicPublishGeo, msg=dict_from_mesh_3, msg_type=value_list_3, send=send_2)  # -> topic, is_advertised
# ---------- mqtt_publisher_2: Python ----------
import ast
import time
import compas
import json
from ghpythonlib.componentbase import executingcomponent as component
from scriptcontext import sticky as st
from threading import Event
from compas_eve import Message, Publisher, Subscriber, Topic, set_default_transport
from compas_eve.mqtt import MqttTransport
from compas_ghpython import create_id

# Import clr and .NET types
import clr
from System.Collections.Generic import IDictionary
from Grasshopper.Kernel.Types import IGH_Goo

class MQTTTopicPublish(component):
    
    def RunScript(self, host, topic_name, msg, msg_type, send):
        # Check for required inputs
        if not host:
            raise ValueError('Please specify host')
        if not topic_name:
            raise ValueError('Please specify the name of the topic')
        
        # Create a unique key for storing the topic in sticky
        key = create_id(ghenv.Component, 'mqtt_topic' + topic_name)
        topic = st.get(key, None)
        
        # Initialize MQTT transport with the specified host
        if host:
            tx = MqttTransport(host)
            # Create the topic if it doesn't exist
            if not topic:
                topic = Topic(topic_name, Message)
                time.sleep(0.2)
                st[key] = topic
                
        self.is_advertised = topic
        
        # If msg is None, check if the topic is advertised
        if msg is None:
            if self.is_advertised:
                ghenv.Component.Message = 'Topic advertised'
                
        else:
            # Handle different message types
            if send:
                message = self.convert_msg(msg, msg_type)
                
                # Encode the message and publish it
                message_encoded = Message(result=message)
                Publisher(topic, transport=tx).publish(message_encoded)
                
                ghenv.Component.Message = 'Message published'

        print (topic.name)   
        return topic.name, self.is_advertised
        
    def convert_msg(self, msg, msg_type):
        if msg_type in [0, 1, 2, 5]:  # string, int, float, list
            return str(msg)
        elif msg_type == 3:  # bool
            return "True" if bool(msg) else "False"
        elif msg_type == 4:  # dict
            print(type(msg))  # Should output: <class 'dict'>
            # Unwrap the data
            unwrapped_msg = self.unwrap_data(msg)
            return compas.json_dumps(unwrapped_msg, False)
        else:
            print("other")
            return str(msg)
    
    def unwrap_data(self, data):
        # Unwrap GH_ObjectWrapper
        if hasattr(data, 'Value'):
            data = data.Value
        
        # Check for .NET IDictionary types
        if isinstance(data, IDictionary):
            new_data = {}
            for key in data.Keys:
                value = data[key]
                key = self.unwrap_data(key)
                value = self.unwrap_data(value)
                new_data[key] = value
            return new_data
        
        # Handle standard Python dictionaries
        elif isinstance(data, dict):
            new_data = {}
            for key, value in data.items():
                key = self.unwrap_data(key)
                value = self.unwrap_data(value)
                new_data[key] = value
            return new_data
        
        # Handle lists and other iterables
        elif hasattr(data, '__iter__') and not isinstance(data, str):
            return [self.unwrap_data(item) for item in data]
        
        # Unwrap IGH_Goo types
        elif isinstance(data, IGH_Goo):
            return self.unwrap_data(data.ScriptVariable())
        
        else:
            return data
# ---------- end mqtt_publisher_2 ----------

# ----
# Double click the Jump Knob
# 4. Send via MQTT
# Notes: You can add your meshes directly here if you don't care about their names and colors
send_3 = Button()

dict_from_meshes = Python3Script(names=cluster_4.selectedname, colors=cluster_4.color, meshes=cluster_4.geo, design_name=design_name)  # -> data; inputs names: list of String, colors: list of Color, meshes: list of Mesh, design_name: tree of String
# ---------- dict_from_meshes: Python ----------
import Rhino.Geometry as rg

data ={}
data["uid"] =design_name
data["elements"] ={}

i = 0
for mesh in meshes:
    if not names[i]:
        name = "element"+ str(i)
    else:
        name = names[i]
        
    if not [colors[i]]:
        color = [255, 255, 255, 255]
    else:
        color = colors[i]
        
#    data["priority"].append(name)
    data["elements"][name]={}
    data["elements"][name]["name"] = name
    data["elements"][name]["color"] = [color.R/255, color.G/255, color.B/255, color.A/255 ]
    
    list_faces =[]
    for f in mesh.Faces:
        face = [f[0], f[1], f[2]]
        list_faces.append(face)
    data["elements"][name]["faces"] = list_faces
    
    list_vertices =[]
    for v in mesh.Vertices:
        vertex=[v.X, v.Y, v.Z]
        list_vertices.append(vertex)
    data["elements"][name]["vertices"] = list_vertices
    
    list_normals =[]
    for n in mesh.Normals:
        normal=[n.X, n.Y, n.Z]
        list_normals.append(normal)
    data["elements"][name]["normals"] = list_normals
    
    list_uv =[]
    for u in mesh.TextureCoordinates:
        uv=[u.X, u.Y]
        list_uv.append(uv)
    data["elements"][name]["uv"] = list_uv
    
    i+=1

data =[data]
# ---------- end dict_from_meshes ----------
value_list_4 = ValueList({"String": 0, "Integer Number": 1, "Floating Point Number": 2, "Boolean Value": 3, "Dictionary": 4, "List": 5}, selected="Dictionary")
mqtt_publisher_3 = Python3Script(host=host_name, topic_name=ghpython_script.topicPublishGeos, msg=dict_from_meshes, msg_type=value_list_4, send=send_3)  # -> topic, is_advertised; same code as mqtt_publisher_2

python_3_script_3 = Python3Script(mesh=triangulated_mesh_4)  # -> out, compas_mesh, a; inputs mesh: Mesh
# ---------- python_3_script_3: Python ----------
import compas
from compas.datastructures import Mesh
from compas_rhino.conversions import mesh_to_compas

compas_mesh = mesh_to_compas(mesh)

a = compas_mesh.to_jsonstring()
# a = compas_mesh
print (a)


mesh = Mesh.from_jsonstring(a)

json = compas.json_dumps(a)

# print (mesh)

# mesh = Mesh.__from_data__(a)
# ---------- end python_3_script_3 ----------
boolean_toggle = BooleanToggle(True)

# ----
# Save a json file locally (extra)
# Notes: The json file will be saved in the HandTracking/data folder
save = Button()
# 1. Pick your team
to_json_2 = Python3Script(file_name="roof", save=save)  # -> json; inputs file_name: String, pretty: Boolean
# ---------- to_json_2: Python ----------
"""
Serializes COMPAS objects to JSON.
"""

from ghpythonlib.componentbase import executingcomponent as component
import compas
import os
import Rhino
import scriptcontext as sc


class CompasInfo(component):
    def RunScript(self, data, file_name: str, pretty: bool, save):
        # Get the folder path of the current Grasshopper document
        gh_document = sc.doc
        if gh_document is not None:
            base_folder = os.path.dirname(gh_document.Path)
        else:
            base_folder = ""
        
        # Define the relative path to the 'data' folder
        data_folder_relative_path = os.path.join("..", "data")
        data_folder_path = os.path.abspath(os.path.join(base_folder, data_folder_relative_path))
        
        # Create the 'data' folder if it does not exist
        if not os.path.exists(data_folder_path):
            os.makedirs(data_folder_path)
        
        # Construct the file path inside the 'data' folder
        filepath = os.path.join(data_folder_path, file_name + ".json")
        json = filepath
        if save:
            if filepath:
                compas.json_dump(data, filepath, pretty)
            else:
                json = compas.json_dumps(data, pretty)

        return json
# ---------- end to_json_2 ----------

# ----
# Notes: The json file will be saved in the HandTracking/data folder
save_2 = Button()
to_json_3 = Python3Script(file_name=cluster_3.selectedname, save=save_2)  # -> json; inputs file_name: String, pretty: Boolean; same code as to_json_2

# ----
# Notes: The json file will be saved in the HandTracking/data folder
save_3 = Button()
to_json_4 = Python3Script(file_name=design_name, save=save_3)  # -> json; inputs file_name: String, pretty: Boolean; same code as to_json_2

python_3_script_4 = Python3Script()  # -> out, a; unedited script template
to_json_5 = ToJSON()  # -> json; inputs pretty: Boolean
#   port data: COMPAS data objects to serialize.
#   port filepath: File path where to store the JSON file. If empty, it will not store to disk but instead return the JSON string.
#   port pretty: If True, JSON data will be formatted with indentation and key sorting.
#   port json: JSON file path or JSON string.
# ---------- to_json_5: Python ----------
"""
Serializes COMPAS objects to JSON.
"""

from ghpythonlib.componentbase import executingcomponent as component

import compas


class CompasInfo(component):
    def RunScript(self, data, filepath, pretty):
        json = filepath

        if filepath:
            compas.json_dump(data, filepath, pretty)
        else:
            json = compas.json_dumps(data, pretty)

        return json
# ---------- end to_json_5 ----------
python_3_script_5 = Python3Script()  # -> out, a; unedited script template
to_json_6 = Python3Script(data=python_3_script_3.a, file_name="test_mesh", save=Button())  # -> json; inputs file_name: String, pretty: Boolean; same code as to_json_2

# ----
# ------------------------   Receive Drawings    ------------------------
# 2. Subscribe to a Topic
# Double click the Jump Knob
# Notes: a) Reset once when you start
# b) Reset if there is any problem with the communication
button = Button()
mqtt_subscriber = Python3Script(host=host_name, topic=ghpython_script.topicSubscribe, reset=button)  # -> out, last_message
# ---------- mqtt_subscriber: Python ----------
#Subscriber Component Imports
from __future__ import print_function
import time
import json
import random
import threading
from System.Threading.Tasks import Task
from System.Threading import ManualResetEventSlim

from ghpythonlib.componentbase import executingcomponent as component
from scriptcontext import sticky as st

from compas_eve import Message, Topic, Subscriber
from compas_eve.mqtt import MqttTransport
from compas_ghpython import create_id
from compas_ghpython.timer import update_component

import Rhino
import System


class BackgroundWorker(object):
    """A class representing a background worker for performing asynchronous tasks."""
    def __init__(self, ghenv):
        super(BackgroundWorker, self).__init__()
        self.ghenv = ghenv
        self._is_working = False
        self._is_done = False
        self._is_cancelled = False
        self._has_requested_cancellation = False

    def is_working(self):
        return self._is_working

    def is_done(self):
        return self._is_done

    def has_requested_cancellation(self):
        return self._has_requested_cancellation

    def request_cancellation(self):
        self._has_requested_cancellation = True
        self.thread.join(timeout=3)

    def start_work(self):
        self.thread = threading.Thread(target=self.do_work)
        self.thread.start()

    def set_internal_state_to_working(self):
        self._is_working = True
        self._is_done = False
        self._is_cancelled = False

    def set_internal_state_to_done(self, result):
        self._is_working = False
        self._is_done = True
        self._is_cancelled = False
        self.result = result
        update_component(self.ghenv, 1)

    def set_internal_state_to_cancelled(self):
        self._is_working = False
        self._is_done = False
        self._is_cancelled = True
        
    def do_work(self):
        pass

    def display_progress(self, progress):
        self.display_message("Progress {:.1f}%".format(progress * 100))

    def display_message(self, message):
        def ui_callback():
            self.ghenv.Component.Message = message
            self.ghenv.Component.OnDisplayExpired(True)
        Rhino.RhinoApp.InvokeOnUiThread(System.Action(ui_callback))

    @classmethod
    def instance_by_component(cls, ghenv, force_new=False):
        """Get the worker instance assigned to the component.
        
        This will get a persistant instance of a background worker
        for a given component. For debugging purposes, `force_new` can
        be set to `True` to request a new instance to be created.
        """
        key = create_id(ghenv.Component, 'background_worker')
        worker = st.get(key)

        if worker and force_new:
            worker.request_cancellation()
            worker.display_message("Cancelled")
            del st[key]

        if not worker:
            worker = cls(ghenv)
            st[key] = worker
        
        return worker


class SimpleExampleBackgroundWorker(BackgroundWorker):
    def do_work(self):
        """Perform the actual work in a background thread."""
        
        # This is only an example of how to write a "do_work" method in a background worker,
        # the code can do whatever, it can be blocking if needed, long/running, anything,
        # the important part is that it calls the methods `set_internal_state_to_*`
        # at the right times
        self.set_internal_state_to_working()

        t = 200
        result = dict()
        for i in range(t):
            if self.has_requested_cancellation():
                self.display_message("Cancelled")
                self.set_internal_state_to_cancelled()
                break

            self.display_progress(i / (t-1))
            time.sleep(.1)

            result['a'] = "Counted up to {}".format(t)

        self.set_internal_state_to_done(result)




class SubscriberBackgroundWorker(BackgroundWorker):
    def do_work(self):
        self.set_internal_state_to_working()
        results = {"messages": []}
        self.messages = results["messages"]
        
        def on_message(message):
            try:
                results["messages"].append(message)
                update_component(self.ghenv, 1)
            except Exception as e:
                self.display_message("Exception: {}".format(e))

        tx = MqttTransport(self.host)
        subscriber = Subscriber(Topic(self.topic, Message), callback=on_message, transport=tx)
        subscriber.subscribe()

        try:
            self.display_message("Starting...")
            while True:
                self.display_message("Received {} messages".format(len(results["messages"])))
                if self.has_requested_cancellation():
                    self.display_message("Cancelled")
                    self.set_internal_state_to_cancelled()
                    break
                
                time.sleep(0.5)
        except Exception as e:
            self.display_message("Exception in threaded worker: " + str(e))
        finally:
            subscriber.unsubscribe()

        self.set_internal_state_to_done(results)

class SubscriberComponent(component):
    def RunScript(self, host, topic, reset):
        self.worker = SubscriberBackgroundWorker.instance_by_component(ghenv, force_new=reset)
        self.worker.host = host
        self.worker.topic = topic

        if not self.worker.is_working() and not self.worker.is_done():
            self.worker.display_message("Starting work..")
            time.sleep(.5)

            self.worker.start_work()

        print("is_working", self.worker.is_working())
        print("is_done", self.worker.is_done())

        last_message = None
        if hasattr(self.worker, "messages") and len(self.worker.messages):
            last_message = self.worker.messages[-1].data["result"]
            print("Received {} total messages".format(len(self.worker.messages)))
            #for msg in self.worker.messages:
                 #print("Request #{}".format(msg))

        return (last_message, )
# ---------- end mqtt_subscriber ----------

mqtt_subscriber_2 = Python3Script(host=host_name, topic=ghpython_script.topicPublishLines, reset=button)  # -> out, last_message
# ---------- mqtt_subscriber_2: Python ----------
#Subscriber Component Imports
from __future__ import print_function
import time
import json
import random
import threading
from System.Threading.Tasks import Task
from System.Threading import ManualResetEventSlim

from ghpythonlib.componentbase import executingcomponent as component
from scriptcontext import sticky as st

from compas_eve import Message, Topic, Subscriber, BinaryMessageCodec
from compas_eve.mqtt import MqttTransport
from compas_ghpython import create_id
from compas_ghpython.timer import update_component

import Rhino
import System


class BackgroundWorker(object):
    """A class representing a background worker for performing asynchronous tasks."""
    def __init__(self, ghenv):
        super(BackgroundWorker, self).__init__()
        self.ghenv = ghenv
        self._is_working = False
        self._is_done = False
        self._is_cancelled = False
        self._has_requested_cancellation = False

    def is_working(self):
        return self._is_working

    def is_done(self):
        return self._is_done

    def has_requested_cancellation(self):
        return self._has_requested_cancellation

    def request_cancellation(self):
        self._has_requested_cancellation = True
        self.thread.join(timeout=3)

    def start_work(self):
        self.thread = threading.Thread(target=self.do_work)
        self.thread.start()

    def set_internal_state_to_working(self):
        self._is_working = True
        self._is_done = False
        self._is_cancelled = False

    def set_internal_state_to_done(self, result):
        self._is_working = False
        self._is_done = True
        self._is_cancelled = False
        self.result = result
        update_component(self.ghenv, 1)

    def set_internal_state_to_cancelled(self):
        self._is_working = False
        self._is_done = False
        self._is_cancelled = True
        
    def do_work(self):
        pass

    def display_progress(self, progress):
        self.display_message("Progress {:.1f}%".format(progress * 100))

    def display_message(self, message):
        def ui_callback():
            self.ghenv.Component.Message = message
            self.ghenv.Component.OnDisplayExpired(True)
        Rhino.RhinoApp.InvokeOnUiThread(System.Action(ui_callback))

    @classmethod
    def instance_by_component(cls, ghenv, force_new=False):
        """Get the worker instance assigned to the component.
        
        This will get a persistant instance of a background worker
        for a given component. For debugging purposes, `force_new` can
        be set to `True` to request a new instance to be created.
        """
        key = create_id(ghenv.Component, 'background_worker')
        worker = st.get(key)

        if worker and force_new:
            worker.request_cancellation()
            worker.display_message("Cancelled")
            del st[key]

        if not worker:
            worker = cls(ghenv)
            st[key] = worker
        
        return worker


class SimpleExampleBackgroundWorker(BackgroundWorker):
    def do_work(self):
        """Perform the actual work in a background thread."""
        
        # This is only an example of how to write a "do_work" method in a background worker,
        # the code can do whatever, it can be blocking if needed, long/running, anything,
        # the important part is that it calls the methods `set_internal_state_to_*`
        # at the right times
        self.set_internal_state_to_working()

        t = 200
        result = dict()
        for i in range(t):
            if self.has_requested_cancellation():
                self.display_message("Cancelled")
                self.set_internal_state_to_cancelled()
                break

            self.display_progress(i / (t-1))
            time.sleep(.1)

            result['a'] = "Counted up to {}".format(t)

        self.set_internal_state_to_done(result)




class SubscriberBackgroundWorker(BackgroundWorker):
    def do_work(self):
        self.set_internal_state_to_working()
        results = {"messages": []}
        self.messages = results["messages"]
        
        def on_message(message):
            try:
                results["messages"].append(message)
                update_component(self.ghenv, 1)
            except Exception as e:
                self.display_message("Exception: {}".format(e))

        tx = MqttTransport(self.host, codec = BinaryMessageCodec())
        subscriber = Subscriber(Topic(self.topic, Message), callback=on_message, transport=tx)
        subscriber.subscribe()

        try:
            self.display_message("Starting...")
            while True:
                self.display_message("Received {} messages".format(len(results["messages"])))
                if self.has_requested_cancellation():
                    self.display_message("Cancelled")
                    self.set_internal_state_to_cancelled()
                    break
                
                time.sleep(0.5)
        except Exception as e:
            self.display_message("Exception in threaded worker: " + str(e))
        finally:
            subscriber.unsubscribe()

        self.set_internal_state_to_done(results)

class SubscriberComponent(component):
    def RunScript(self, host, topic, reset):
        self.worker = SubscriberBackgroundWorker.instance_by_component(ghenv, force_new=reset)
        self.worker.host = host
        self.worker.topic = topic

        if not self.worker.is_working() and not self.worker.is_done():
            self.worker.display_message("Starting work..")
            time.sleep(.5)

            self.worker.start_work()

        print("is_working", self.worker.is_working())
        print("is_done", self.worker.is_done())

        last_message = None
        if hasattr(self.worker, "messages") and len(self.worker.messages):
            last_message = self.worker.messages[-1].data["result"]
            print("Received {} total messages".format(len(self.worker.messages)))
            #for msg in self.worker.messages:
                 #print("Request #{}".format(msg))

        return (last_message, )
# ---------- end mqtt_subscriber_2 ----------
panel_6 = Panel(mqtt_subscriber_2.last_message)

visualize_curves_geo_pins = Python3Script(result=mqtt_subscriber.last_message, geoDict=cluster_3.geodict, thickness=Slider(5, range=0..100))  # -> lines, controlPoints, pinFrames, Tmeshes
# ---------- visualize_curves_geo_pins: Python ----------
from ghpythonlib.componentbase import executingcomponent as component
import Rhino
import System
import Rhino.Geometry as rg
import rhinoscriptsyntax as rs
import compas
from compas.geometry import NurbsCurve, Frame, Transformation, Point
from compas_rhino.conversions import curve_to_rhino, transformation_to_rhino, frame_to_rhino
import ghpythonlib.treehelpers as th
from System.Collections import IDictionary
from Grasshopper.Kernel.Types import IGH_Goo



class CurveColor(component):
    def RunScript(self, result, geoDict, thickness):
        self.t = thickness
        self.lines = []
        self.colors = []
        self.meshes = []
        lines =[]
        Tmeshes=[]
        controlPoints=[]
        pinFrames=[]
        if result:
            result = self.unwrap_data(result)
            frame_MCF = Frame(result["MCF"]["point"], result["MCF"]["xaxis"], result["MCF"]["yaxis"])
            T_MCF_to_WCF = Transformation.from_frame_to_frame(frame_MCF, Frame.worldXY())
            
            
            for key, vl in result["lines"].items():
                print (key)
                cp =[]
                cp_rhino=[]
                positions = vl["positions"]
                color = System.Drawing.Color.FromArgb(int(vl["color"][3]*255), int(vl["color"][0]*255), int(vl["color"][1]*255), int(vl["color"][2]*255))

                if len(positions) > 1:
                    
                    for pos in positions:
                        point_MCF = Point(pos[0], pos[1], pos[2]) # point in Markers Coordinate System
                        point_WCF = point_MCF.transformed(T_MCF_to_WCF)
                        cp.append(point_WCF)
                        pt_rhino = rg.Point3d(point_WCF.x, point_WCF.y, point_WCF.z)
                        cp_rhino.append(pt_rhino)
#                        controlPoints.append(point_WCF)
                    
                    controlPoints.append(cp_rhino)
                    line_WCF = NurbsCurve.from_interpolation(cp)  
                    line = curve_to_rhino(line_WCF)
                    lines.append(line)
                    self.lines.append((line, color))
            for key, value in result["objectFrames"].items():
                frame = Frame(value["point"], value["xaxis"], value["yaxis"])
                T = Transformation.from_frame_to_frame(Frame.worldXY(),frame)
                T_rhino = rg.Transform.Multiply(transformation_to_rhino(T_MCF_to_WCF), transformation_to_rhino(T))
                transformedMesh = geoDict[key]["geometry"].DuplicateMesh()
                transformedMesh.Transform(T_rhino)
                Tmeshes.append(transformedMesh)
                
                mesh_color = geoDict[key]["color"]
                mesh_material = Rhino.Display.DisplayMaterial(mesh_color, 0.65)
                
                self.meshes.append((transformedMesh, mesh_material))
                
            if "pinPoints" in result:
                for key,vl in result["pinPoints"].items():
                    pinFrame_MCF = Frame(vl["point"], vl["xaxis"], vl["yaxis"])
                    pinFrame_WCF = pinFrame_MCF.transformed(T_MCF_to_WCF)
                    pinFrames.append(frame_to_rhino(pinFrame_WCF))
                    
        controlPoints = th.list_to_tree(controlPoints)
        return lines, controlPoints, pinFrames, Tmeshes

    def unwrap_data(self, data):
        # Unwrap GH_ObjectWrapper
        if hasattr(data, 'Value'):
            data = data.Value
        
        # Check for .NET IDictionary types
        if isinstance(data, IDictionary):
            new_data = {}
            for key in data.Keys:
                value = data[key]
                key = self.unwrap_data(key)
                value = self.unwrap_data(value)
                new_data[key] = value
            return new_data
        
        # Handle standard Python dictionaries
        elif isinstance(data, dict):
            new_data = {}
            for key, value in data.items():
                key = self.unwrap_data(key)
                value = self.unwrap_data(value)
                new_data[key] = value
            return new_data
        
        # Handle lists and other iterables
        elif hasattr(data, '__iter__') and not isinstance(data, str):
            return [self.unwrap_data(item) for item in data]
        
        # Unwrap IGH_Goo types
        elif isinstance(data, IGH_Goo):
            return self.unwrap_data(data.ScriptVariable())
        
        else:
            return data

    def DrawViewportWires(self, arg):
        for line, color in self.lines:
            arg.Display.DrawCurve(line, color, self.t)
        
    def DrawViewportMeshes(self, arg):
        for mesh, color in self.meshes:
            arg.Display.DrawMeshShaded(mesh, color)
# ---------- end visualize_curves_geo_pins ----------
geometry = Geometry(visualize_curves_geo_pins.Tmeshes)
curves = Curve(visualize_curves_geo_pins.lines)
points = Point(visualize_curves_geo_pins.controlPoints)
planes = Plane(visualize_curves_geo_pins.pinFrames)

# ----
# ------------------------   Read from a backUp file    ------------------------
# Notes: The backUp files can be restored from the Hololens
backup_json = Panel("C:\Users\eleni\AppData\LocalLow\DefaultCompany\HandTrackingExample\20240717160206_teamA_backup.json")

from_json_2 = Python3Script(json=backup_json)  # -> result
# ---------- from_json_2: Python ----------
"""
Deserializes JSON into COMPAS objects.
"""

from ghpythonlib.componentbase import executingcomponent as component

import compas
from System.Collections import IDictionary
from Grasshopper.Kernel.Types import IGH_Goo


class CompasInfo(component):
    def RunScript(self, json):
        if not json:
            return None

        try:
            return [compas.json_load(json)]
        except:  # noqa: E722
            return [compas.json_load(json)]
    
    def unwrap_data(self, data):
        # Unwrap GH_ObjectWrapper
        if hasattr(data, 'Value'):
            data = data.Value
        
        # Check for .NET IDictionary types
        if isinstance(data, IDictionary):
            new_data = {}
            for key in data.Keys:
                value = data[key]
                key = self.unwrap_data(key)
                value = self.unwrap_data(value)
                new_data[key] = value
            return new_data
        
        # Handle standard Python dictionaries
        elif isinstance(data, dict):
            new_data = {}
            for key, value in data.items():
                key = self.unwrap_data(key)
                value = self.unwrap_data(value)
                new_data[key] = value
            return new_data
        
        # Handle lists and other iterables
        elif hasattr(data, '__iter__') and not isinstance(data, str):
            return [self.unwrap_data(item) for item in data]
        
        # Unwrap IGH_Goo types
        elif isinstance(data, IGH_Goo):
            return self.unwrap_data(data.ScriptVariable())
        
        else:
            return data
# ---------- end from_json_2 ----------

visualize_curves_geo_pins_2 = Python3Script(result=from_json_2, geoDict=cluster_3.geodict, drawingIndex=Slider(0, range=0..10), thickness=Slider(4, range=0..100))  # -> lines, controlPoints, pinFrames, Tmeshes
# ---------- visualize_curves_geo_pins_2: Python ----------
from ghpythonlib.componentbase import executingcomponent as component
import Rhino
import System
import Rhino.Geometry as rg
import rhinoscriptsyntax as rs

from compas.geometry import NurbsCurve, Frame, Transformation, Point
from compas_rhino.conversions import curve_to_rhino, transformation_to_rhino, frame_to_rhino
import ghpythonlib.treehelpers as th
from System.Collections import IDictionary
from Grasshopper.Kernel.Types import IGH_Goo



class CurveColor(component):
    def RunScript(self, result, geoDict, drawingIndex, thickness):
        self.t = thickness
        self.lines = []
        self.colors = []
        self.meshes = []
        lines =[]
        Tmeshes=[]
        controlPoints=[]
        pinFrames=[]
        if result:
            result = self.unwrap_data(result)
            result = result["drawings"][f"drawing{int(drawingIndex)}"]
            frame_MCF = Frame(result["MCF"]["point"], result["MCF"]["xaxis"], result["MCF"]["yaxis"])
            T_MCF_to_WCF = Transformation.from_frame_to_frame(frame_MCF, Frame.worldXY())
            
            
            for key, vl in result["lines"].items():
                cp =[]
                cp_rhino=[]
                positions = vl["positions"]
                color = System.Drawing.Color.FromArgb(int(vl["color"][3]*255), int(vl["color"][0]*255), int(vl["color"][1]*255), int(vl["color"][2]*255))

                if len(positions) > 1:
                    
                    for pos in positions:
                        point_MCF = Point(pos[0], pos[1], pos[2]) # point in Markers Coordinate System
                        point_WCF = point_MCF.transformed(T_MCF_to_WCF)
                        cp.append(point_WCF)
                        pt_rhino = rg.Point3d(point_WCF.x, point_WCF.y, point_WCF.z)
                        cp_rhino.append(pt_rhino)
                        # controlPoints.append(point_WCF)
                    
                    controlPoints.append(cp_rhino)
                    line_WCF = NurbsCurve.from_interpolation(cp)  
                    line = curve_to_rhino(line_WCF)
                    lines.append(line)
                    self.lines.append((line, color))
            for key, value in result["objectFrames"].items():
                frame = Frame(value["point"], value["xaxis"], value["yaxis"])
                T = Transformation.from_frame_to_frame(Frame.worldXY(),frame)
                T_rhino = rg.Transform.Multiply(transformation_to_rhino(T_MCF_to_WCF), transformation_to_rhino(T))
                transformedMesh = geoDict[key]["geometry"].DuplicateMesh()
                transformedMesh.Transform(T_rhino)
                Tmeshes.append(transformedMesh)
                
                mesh_color = geoDict[key]["color"]
                mesh_material = Rhino.Display.DisplayMaterial(mesh_color, 0.65)
                
                self.meshes.append((transformedMesh, mesh_material))
                
            if "pinPoints" in result:
                for key,vl in result["pinPoints"].items():
                    pinFrame_MCF = Frame(vl["point"], vl["xaxis"], vl["yaxis"])
                    pinFrame_WCF = pinFrame_MCF.transformed(T_MCF_to_WCF)
                    pinFrames.append(frame_to_rhino(pinFrame_WCF))
                    
        controlPoints = th.list_to_tree(controlPoints)
        return lines, controlPoints, pinFrames, Tmeshes

    def unwrap_data(self, data):
        # Unwrap GH_ObjectWrapper
        if hasattr(data, 'Value'):
            data = data.Value
        
        # Check for .NET IDictionary types
        if isinstance(data, IDictionary):
            new_data = {}
            for key in data.Keys:
                value = data[key]
                key = self.unwrap_data(key)
                value = self.unwrap_data(value)
                new_data[key] = value
            return new_data
        
        # Handle standard Python dictionaries
        elif isinstance(data, dict):
            new_data = {}
            for key, value in data.items():
                key = self.unwrap_data(key)
                value = self.unwrap_data(value)
                new_data[key] = value
            return new_data
        
        # Handle lists and other iterables
        elif hasattr(data, '__iter__') and not isinstance(data, str):
            return [self.unwrap_data(item) for item in data]
        
        # Unwrap IGH_Goo types
        elif isinstance(data, IGH_Goo):
            return self.unwrap_data(data.ScriptVariable())
        
        else:
            return data
     
    def DrawViewportWires(self, arg):
        for line, color in self.lines:
            arg.Display.DrawCurve(line, color, self.t)
        
    def DrawViewportMeshes(self, arg):
        for mesh, color in self.meshes:
            arg.Display.DrawMeshShaded(mesh, color)
# ---------- end visualize_curves_geo_pins_2 ----------
points_2 = Point(visualize_curves_geo_pins_2.controlPoints)
plane = Plane(visualize_curves_geo_pins_2.pinFrames)

geometry_2 = Geometry(visualize_curves_geo_pins_2.Tmeshes)
curve_2 = Curve(visualize_curves_geo_pins_2.lines)

# ==== cluster ARMarker
ar_marker = Rectangle({Plane=PlaneXY(0.0375, -0.0375, 0), Size=Domain2(u=-0.0375..0.0375, v=-0.0375..0.0375)})
border = OffsetCurve(Curve=ar_marker, Distance="0.01", Corners=1)
geometry = Geometry([border, ar_marker])
ar_marker_2 = Geometry([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])
ar_marker_3 = ClusterOutput(ar_marker_2)

# ==== cluster Cluster
sif_pattern = Panel("""0
1
2""")
list = ClusterInput()
sift_pattern = SiftPattern(List=list, SiftPattern=sif_pattern)  # -> Output0, Output1, Output2
dispatch = Dispatch(List=list, DispatchPattern=[True, False])  # -> Geometries, ListB
geometries = Data(sift_pattern.Output0)
colors = Data(sift_pattern.Output2)
names = Data(sift_pattern.Output1)
index = ClusterInput()
create_dict = GhPythonScript(geometries=geometries, names=names, colors=colors, index=index)  # -> out, selectedName, geo, color, geoDict; inputs geometries: list of Mesh, names: list, colors: list of Color, index: Int32
# ---------- create_dict: Python ----------
import Rhino.Geometry as rg

geom=[]
for geo in geometries:
    if geo !=None:
        geom.append(geo)
geometries = geom

nms=[]
for name in names:
    if name !=None:
        nms.append(name)
names = nms

clrs=[]
for color in colors:
    if color !=None:
        clrs.append(color)
colors = clrs

geoDict ={}

for i, name in enumerate (names):
    geoDict[name] = {}
    geoDict[name]["color"] = colors[i]
    geoDict[name]["geometry"] = geometries[i]

geoDict =[geoDict]
color = colors[index]
selectedName = names[index]
geo = geometries[index]
# ---------- end create_dict ----------
geodict = ClusterOutput(create_dict.geoDict)
selectedname = ClusterOutput(create_dict.selectedName)
geo = ClusterOutput(create_dict.geo)
color = ClusterOutput(create_dict.color)

# ==== cluster Cluster_2
value = ClusterInput()
_2_defect = ColourSwatch(SwatchColor=RGB(82, 135, 227))
_0_edges = ColourSwatch(SwatchColor=RGB(99, 135, 105))
_1_clear = ColourSwatch(SwatchColor=RGB(255, 239, 161))
types = ClusterInput()
negative = Negative(Value=value)
curve = ClusterInput()
distance = ClusterInput()
color_mapping = GhPythonScript(options=[_0_edges, _1_clear, _2_defect], types=types)  # -> out, colors; inputs options: list of Color, types: list of Int32
# ---------- color_mapping: Python ----------
colors=[]

for type in types:
    colors.append(options[type])
# ---------- end color_mapping ----------
factor = ClusterInput()
offset_curve = OffsetCurve(Curve=curve, Plane=PlaneXY(0, 0, 0), Distance=distance, BothSides=negative, Kinks=0, CapType=1)
unit_z = UnitZ(Factor=factor)
colors = ClusterOutput(color_mapping.colors)
extrude = Extrude(Base=offset_curve, Direction=unit_z)
cap_holes = CapHoles(Brep=extrude)
brep = ClusterOutput(cap_holes)
