# Grasshopper definition Mqtt-Communication_demo.ghx (Grasshopper 1.0.7)
# plug-ins: Pufferfish

geometry = Geometry(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)

colour = ColourSwatch(SwatchColor=RGB(197, 184, 217))
# ------------------------    Send  Geos to AR   ------------------------
triangulated_mesh = Mesh(geometry)

panel = Panel("D")
triangulated_mesh_2 = Mesh(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)

panel_2 = Panel("E")
triangulated_mesh_3 = Mesh(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)

triangulated_mesh_4 = Mesh(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)

triangulated_mesh_5 = Mesh(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)

colour_2 = ColourSwatch(SwatchColor=RGB(184, 217, 192))

colour_3 = ColourSwatch(SwatchColor=RGB(197, 184, 217))

colour_4 = ColourSwatch(SwatchColor=RGB(165, 105, 255))

# ----
# ------------------------   Receive Drawings    ------------------------
# 1. Define your Team's Name
# Double click the Jump Knob
colour_5 = ColourSwatch(SwatchColor=RGB(165, 105, 255))

# ----
# 1. Select Curves
# Define your team's name
# Double click the Jump Knob
curve = Curve([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])
# Notes: a) Add Curves ( Periodic or not)
# b) Give a name to the drawing
# c) The Color not working at the moment
number_slider = Slider(0, range=0..15)
curve_edit_points = CurveEditPoints(Curve=curve, Knots=True)  # -> Points, Tangents, Parameters
colour_6 = ColourSwatch(SwatchColor=RGB(165, 105, 255))
dictionary = GhPythonScript(curves=curve, points=curve_edit_points.Points, drawingIndex=number_slider, name="roof", color=colour_6)  # -> data; inputs curves: list of Curve, points: tree of Point3d, color: Color
# ---------- dictionary: Python ----------
import ghpythonlib.treehelpers as th
import Rhino.Geometry as rg

points = th.tree_to_list(points)

drawing_name = "drawingR" + str(drawingIndex)
data ={}
data["uid"] = name
data["drawings"] ={}
data["drawings"][drawing_name] ={}
data["drawings"][drawing_name]["lines"] ={}
data["drawings"][drawing_name]["scale"] =1.0

i=0
for curve in curves:
    if curve!=None:
        data["drawings"][drawing_name]["lines"]["line"+str(i)] = {}
        print curve.IsClosed
        data["drawings"][drawing_name]["lines"]["line"+str(i)]["periodic"] = curve.IsClosed
        data["drawings"][drawing_name]["lines"]["line"+str(i)]["color"] = [color.R/255, color.G/255, color.B/255, color.A/255 ]
        pts=[]
        for point in points[i]:
            pt = [point.X, point.Y, point.Z]
            pts.append(pt)
        data["drawings"][drawing_name]["lines"]["line"+str(i)]["positions"] =pts
        i+=1

data=[data]
# ---------- end dictionary ----------

# ----
# GLOBAL SETTINGS
# ------------------------    Send  Curves to AR    ------------------------
host_name = Panel("localhost")
ar_marker = ARMarker()
tablemenu_area = Rectangle({Plane=PlaneXY(0.2491139817, -0.0375, 0), Size=Domain2(u=-0.1312275416..0.1312275416, v=-0.0475..0.0475)})
team_name = Panel("teamA")

# ----
# 1. Add New Geometries
# Notes: a) Use only triangulated Mesh
# b) Follow the pattern : Mesh/ Name/ Color for new entries
# c) Use unique names for each entry
geometries = Merge(
    Data1=triangulated_mesh,
    Data2="G",
    Data3=colour,
    Data4=triangulated_mesh_4,
    Data5="H",
    Data6=colour_2,
    Data7=triangulated_mesh_5,
    Data8="I",
    Data9=colour_3)

backup_json = Panel("C:\Users\eleni\AppData\LocalLow\DefaultCompany\HandTrackingExample\20250624081739_20250624082146_teamA_drawing1.json")

# ----
# ------------------------   Read from a backUp file    ------------------------
backup_json_2 = Panel("")
# Notes: The backUp files can be restored from the Hololens
number_slider_2 = Slider(4, range=0..100)
from_json = FromJSON(json=backup_json_2)  # -> result
#   port json: JSON file path or JSON string.
#   port result: Deserialized objects.
# ---------- from_json: Python ----------
"""
Deserializes JSON into COMPAS objects.
"""

from ghpythonlib.componentbase import executingcomponent as component

import compas


class CompasInfo(component):
    def RunScript(self, json):
        if not json:
            return None

        try:
            return [compas.json_load(json)]
        except:  # noqa: E722
            return [compas.json_loads(json)]
# ---------- end from_json ----------
visualize_curves_geo_pins = GhPythonScript(result=from_json, drawingIndex=Slider(0, range=0..10), thickness=number_slider_2)  # -> lines, controlPoints, pinFrames, Tmeshes; inputs drawingIndex: Int32
# ---------- visualize_curves_geo_pins: Python ----------
from ghpythonlib.componentbase import executingcomponent as component
import Rhino
import System
import Rhino.Geometry as rg
import rhinoscriptsyntax as rs
from compas.geometry import NurbsCurve, Frame, Transformation,Point
from compas_rhino.conversions import curve_to_rhino, transformation_to_rhino, frame_to_rhino
import ghpythonlib.treehelpers as th


class CurveColor(component):
    def __init__(self):
        self.meshes = []
        self.lines = []
        self.t = 1.0
    
    def RunScript(self, result, geoDict, drawingIndex, thickness):
        self.t = thickness
        self.lines = []
        self.meshes = []
        pinFrames=[]
        controlPoints=[]
        if result:
            drawing = result["drawings"]["drawing" + str(drawingIndex)]
            frame_MCF = Frame(drawing["MCF"]["point"], drawing["MCF"]["xaxis"], drawing["MCF"]["yaxis"])
            T_MCF_to_WCF = Transformation.from_frame_to_frame(frame_MCF, Frame.worldXY())
            
            cp=[]
            for key, vl in drawing["lines"].items():
                
                positions = vl["positions"]
                color = System.Drawing.Color.FromArgb(int(vl["color"][3] * 255), int(vl["color"][0] * 255), int(vl["color"][1] * 255), int(vl["color"][2] * 255))

                if len(positions) > 2:
                    
                    for pos in positions:
                        point_MCF = Point(pos[0], pos[1], pos[2]) # point in Markers Coordinate System
                        point_WCF = point_MCF.transformed(T_MCF_to_WCF)
                        cp.append(point_WCF)
                        
                    line_WCF = NurbsCurve.from_interpolation(cp)  
                    line = curve_to_rhino(line_WCF)
                    self.lines.append((line, color))
                    controlPoints.append(cp)
            
            for key, value in drawing["objectFrames"].items():
                frame = Frame(value["point"], value["xaxis"], value["yaxis"])
                T = Transformation.from_frame_to_frame(Frame.worldXY(), frame)
                T_rhino = rg.Transform.Multiply(transformation_to_rhino(T_MCF_to_WCF), transformation_to_rhino(T))
                transformedMesh = geoDict[key]["geometry"].DuplicateMesh()
                transformedMesh.Transform(T_rhino)
                
                mesh_color = geoDict[key]["color"]
                mesh_material = Rhino.Display.DisplayMaterial(mesh_color, 0.65)
                
                self.meshes.append((transformedMesh, mesh_material))
            
            if "pinPoints" in drawing:
                for key,vl in drawing["pinPoints"].items():
                    pinFrame_MCF = Frame(vl["point"], vl["xaxis"], vl["yaxis"])
                    pinFrame_WCF = pinFrame_MCF.transformed(T_MCF_to_WCF)
                    pinFrames.append(frame_to_rhino(pinFrame_WCF))
                    
        return [line[0] for line in self.lines], controlPoints, pinFrames,  [mesh[0] for mesh in self.meshes]

    def DrawViewportWires(self, arg):
        for line, color in self.lines:
            arg.Display.DrawCurve(line, color, self.t)
    
    def DrawViewportMeshes(self, arg):
        for mesh, color in self.meshes:
            arg.Display.DrawMeshShaded(mesh, color)
# ---------- end visualize_curves_geo_pins ----------
draw = Draw(cg=visualize_curves_geo_pins.controlPoints)  # -> rg
#   port cg: The COMPAS geometry or datastructure to be drawn.
#   port rg: The Rhino geometry object.
# ---------- draw: Python ----------
"""
Draws COMPAS geometry in Grasshopper.
"""

from ghpythonlib.componentbase import executingcomponent as component

from compas.scene import SceneObject


class CompasToRhinoGeometry(component):
    def RunScript(self, cg):
        if not cg:
            return None

        return SceneObject(cg).draw()
# ---------- end draw ----------
geometry_2 = Geometry(visualize_curves_geo_pins.Tmeshes)
curve_2 = Curve(visualize_curves_geo_pins.lines)
plane = Plane(visualize_curves_geo_pins.pinFrames)

# ----
# 2. Select Geos
elements = Panel("0")
# Notes: a) Increase the max value of the domain if needed
cluster = Cluster(list=geometries, index=elements)  # -> names_2, geometries_2, colors_2, geodict

selectedname = Panel(cluster.names_2)
visualize_geo = CustomPreview(SelectedGeo=cluster.geometries_2, Material=ColourSwatch(SwatchColor=RGB(255, 255, 0)))

design_name = Panel("roof")
mesh = Mesh([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])
ghpython_script = GhPythonScript(geoDict=cluster.geodict)  # -> geoDict, meshes
# ---------- ghpython_script: Python ----------
import os
import json
import Rhino.Geometry as rg
import System.Drawing.Color as Color
from scriptcontext import doc

# Set your folder path
folder_path = r"C:\Users\eleni\Documents\GitHub\IntuitiveRobotics-AugmentedTechnologies\HandTracking\rhino\data"
white_transparent = Color.FromArgb(100, 255, 255, 255)  # Alpha=100


# Helper to build Rhino mesh from vertices and faces
def build_mesh(vertices, faces):
    mesh = rg.Mesh()
    for v in vertices:
        mesh.Vertices.Add(*v)
    for f in faces:
        if len(f) == 3:
            mesh.Faces.AddFace(f[0], f[1], f[2])
        elif len(f) == 4:
            mesh.Faces.AddFace(f[0], f[1], f[2], f[3])
    mesh.Normals.ComputeNormals()
    mesh.Compact()
    return mesh

meshes = []

# Iterate over JSON files in folder
for filename in os.listdir(folder_path):
    if filename.endswith(".json"):
        file_path = os.path.join(folder_path, filename)
        name = os.path.splitext(filename)[0]  # Remove ".json"
        with open(file_path, 'r') as f:
            data = json.load(f)

        try:
            vertices = data['mesh']['vertices']
            faces = data['mesh']['faces']
            mesh = build_mesh(vertices, faces)
            meshes.append(mesh)
            geoDict[name] = {
                "geometry": mesh,
                "color": white_transparent
            }
        except KeyError:
            print("Missing 'vertices' or 'faces' in:", filename)

geoDict = [geoDict]
# ---------- end ghpython_script ----------
from_json_2 = FromJSON(json=backup_json)  # -> result; same code as from_json

visualize_crvs_geo_pins = GhPythonScript(result=from_json_2, geoDict=ghpython_script.geoDict, thickness=Slider(3, range=0..100))  # -> lines, controlPoints, pinFrames, Tmeshes
# ---------- visualize_crvs_geo_pins: Python ----------
from ghpythonlib.componentbase import executingcomponent as component
import Rhino
import System
import Rhino.Geometry as rg
import rhinoscriptsyntax as rs
from compas.geometry import NurbsCurve, Frame, Transformation, Point, Scale
from compas_rhino.conversions import curve_to_rhino, transformation_to_rhino, frame_to_rhino
import ghpythonlib.treehelpers as th



class CurveColor(component):
    def RunScript(self, result, geoDict,thickness):
        self.t = thickness
        self.lines = []
        self.colors = []
        self.meshes = []
        lines =[]
        Tmeshes=[]
        controlPoints=[]
        pinFrames=[]
        
        if result:
            frame_MCF = Frame(result["MCF"]["point"], result["MCF"]["xaxis"], result["MCF"]["yaxis"])
            T_MCF_to_WCF = Transformation.from_frame_to_frame(frame_MCF, Frame.worldXY())
            scale = result["scale"]
            if scale==0.0: scale =1.0
            
            for key, vl in result["lines"].items():
                cp =[]
                cp_rhino=[]
                positions = vl["positions"]
                color = System.Drawing.Color.FromArgb(int(vl["color"][3]*255), int(vl["color"][0]*255), int(vl["color"][1]*255), int(vl["color"][2]*255))

                if len(positions) > 1:
                    print vl["periodic"]
                    for pos in positions:
                        point_MCF = Point(pos[0], pos[1], pos[2]) # point in Markers Coordinate System
                        point_WCF = point_MCF.transformed(T_MCF_to_WCF)
                        scaled_pt = point_WCF *(1/scale)
                        cp.append(scaled_pt)
                        pt_rhino = rg.Point3d(scaled_pt.x, scaled_pt.y, scaled_pt.z)
                        cp_rhino.append(pt_rhino)
#                        controlPoints.append(point_WCF)
                    if vl["periodic"]: cp.append(cp[0])
                    controlPoints.append(cp_rhino)
                    line_WCF = NurbsCurve.from_interpolation(cp)  
                    line = curve_to_rhino(line_WCF)
                    lines.append(line)
                    self.lines.append((line, color))
            for key, value in result["objectFrames"].items():
                frame = Frame(value["point"], value["xaxis"], value["yaxis"])
                frame.transform(T_MCF_to_WCF)
                scaled_origin = frame.point *(1/scale)
                scaled_frame = Frame(scaled_origin, frame.xaxis, frame.yaxis)
                T = Transformation.from_frame_to_frame(Frame.worldXY(),scaled_frame)
                
                T_rhino = transformation_to_rhino(T)
                
                transformedMesh = geoDict[key]["geometry"].DuplicateMesh()
                transformedMesh.Transform(T_rhino)
                Tmeshes.append(transformedMesh)
                
                mesh_color = geoDict[key]["color"]
                mesh_material = Rhino.Display.DisplayMaterial(mesh_color, 0.65)
                
                self.meshes.append((transformedMesh, mesh_material))
                
            if "pinPoints" in result:
                for key,vl in result["pinPoints"].items():
                    pinFrame_MCF = Frame(vl["point"], vl["xaxis"], vl["yaxis"])
                    pinFrame_WCF = pinFrame_MCF.transformed(T_MCF_to_WCF)
                    pinFrames.append(frame_to_rhino(pinFrame_WCF))
        
        controlPoints = th.list_to_tree(controlPoints)
        return lines, controlPoints, pinFrames, Tmeshes

    def DrawViewportWires(self, arg):
        for line, color in self.lines:
            arg.Display.DrawCurve(line, color, self.t)
        
    def DrawViewportMeshes(self, arg):
        for mesh, color in self.meshes:
            arg.Display.DrawMeshShaded(mesh, color)
# ---------- end visualize_crvs_geo_pins ----------
geometry_3 = Geometry(visualize_crvs_geo_pins.Tmeshes)
curves = Curve(visualize_crvs_geo_pins.lines)
points = Point(visualize_crvs_geo_pins.controlPoints)
planes = Plane(visualize_crvs_geo_pins.pinFrames)

# ----
# 3. Send via MQTT
send = Button()

# ----
# Double click the Jump Knob
# 4. Send via MQTT
# Notes: You can add your meshes directly here if you don't care about their names and colors
send_2 = Button()

ghpython_script_2 = GhPythonScript(team=team_name)  # -> topicPublishGeos, topicPublishLines, topicSubscribe
# ---------- ghpython_script_2: Python ----------
topicPublishGeos ="/reclaimingcraft_" + team + "_geometries/"
topicPublishLines ="/reclaimingcraft_" + team + "_lines/"
topicSubscribe ="/reclaimingcraft_" + team + "_drawings/"
# ---------- end ghpython_script_2 ----------

# ----
# 2. Subscribe to a Topic
# Notes: a) Reset once when you start
# b) Reset if there is any problem with the communication
button = Button()
mqtt_subscriber = MQTTSubscriber(host=host_name, topic=ghpython_script_2.topicSubscribe, reset=button)  # -> out, last_message
# ---------- mqtt_subscriber: Python ----------
#Subscriber Component Imports
from __future__ import print_function
import time
import json
import random
import threading
from System.Threading.Tasks import Task
from System.Threading import ManualResetEventSlim

from ghpythonlib.componentbase import executingcomponent as component
from scriptcontext import sticky as st

from compas_eve import Message, Topic, Subscriber
from compas_eve.mqtt import MqttTransport
from compas_ghpython import create_id
from compas_ghpython.timer import update_component

import Rhino
import System


class BackgroundWorker(object):
    """A class representing a background worker for performing asynchronous tasks."""
    def __init__(self, ghenv):
        super(BackgroundWorker, self).__init__()
        self.ghenv = ghenv
        self._is_working = False
        self._is_done = False
        self._is_cancelled = False
        self._has_requested_cancellation = False

    def is_working(self):
        return self._is_working

    def is_done(self):
        return self._is_done

    def has_requested_cancellation(self):
        return self._has_requested_cancellation

    def request_cancellation(self):
        self._has_requested_cancellation = True
        self.thread.join(timeout=3)

    def start_work(self):
        self.thread = threading.Thread(target=self.do_work)
        self.thread.start()

    def set_internal_state_to_working(self):
        self._is_working = True
        self._is_done = False
        self._is_cancelled = False

    def set_internal_state_to_done(self, result):
        self._is_working = False
        self._is_done = True
        self._is_cancelled = False
        self.result = result
        update_component(self.ghenv, 1)

    def set_internal_state_to_cancelled(self):
        self._is_working = False
        self._is_done = False
        self._is_cancelled = True
        
    def do_work(self):
        pass

    def display_progress(self, progress):
        self.display_message("Progress {:.1f}%".format(progress * 100))

    def display_message(self, message):
        def ui_callback():
            self.ghenv.Component.Message = message
            self.ghenv.Component.OnDisplayExpired(True)
        Rhino.RhinoApp.InvokeOnUiThread(System.Action(ui_callback))

    @classmethod
    def instance_by_component(cls, ghenv, force_new=False):
        """Get the worker instance assigned to the component.
        
        This will get a persistant instance of a background worker
        for a given component. For debugging purposes, `force_new` can
        be set to `True` to request a new instance to be created.
        """
        key = create_id(ghenv.Component, 'background_worker')
        worker = st.get(key)

        if worker and force_new:
            worker.request_cancellation()
            worker.display_message("Cancelled")
            del st[key]

        if not worker:
            worker = cls(ghenv)
            st[key] = worker
        
        return worker


class SimpleExampleBackgroundWorker(BackgroundWorker):
    def do_work(self):
        """Perform the actual work in a background thread."""
        
        # This is only an example of how to write a "do_work" method in a background worker,
        # the code can do whatever, it can be blocking if needed, long/running, anything,
        # the important part is that it calls the methods `set_internal_state_to_*`
        # at the right times
        self.set_internal_state_to_working()

        t = 200
        result = dict()
        for i in range(t):
            if self.has_requested_cancellation():
                self.display_message("Cancelled")
                self.set_internal_state_to_cancelled()
                break

            self.display_progress(i / (t-1))
            time.sleep(.1)

            result['a'] = "Counted up to {}".format(t)

        self.set_internal_state_to_done(result)




class SubscriberBackgroundWorker(BackgroundWorker):
    def do_work(self):
        self.set_internal_state_to_working()
        results = {"messages": []}
        self.messages = results["messages"]
        
        def on_message(message):
            try:
                results["messages"].append(message)
                update_component(self.ghenv, 1)
            except Exception as e:
                self.display_message("Exception: {}".format(e))

        tx = MqttTransport(self.host)
        subscriber = Subscriber(Topic(self.topic, Message), callback=on_message, transport=tx)
        subscriber.subscribe()

        try:
            self.display_message("Starting...")
            while True:
                self.display_message("Received {} messages".format(len(results["messages"])))
                if self.has_requested_cancellation():
                    self.display_message("Cancelled")
                    self.set_internal_state_to_cancelled()
                    break
                
                time.sleep(0.5)
        except Exception as e:
            self.display_message("Exception in threaded worker: " + str(e))
        finally:
            subscriber.unsubscribe()

        self.set_internal_state_to_done(results)

class SubscriberComponent(component):
    def RunScript(self, host, topic, reset):
        self.worker = SubscriberBackgroundWorker.instance_by_component(ghenv, force_new=reset)
        self.worker.host = host
        self.worker.topic = topic

        if not self.worker.is_working() and not self.worker.is_done():
            self.worker.display_message("Starting work..")
            time.sleep(.5)

            self.worker.start_work()

        print("is_working", self.worker.is_working())
        print("is_done", self.worker.is_done())

        last_message = None
        if hasattr(self.worker, "messages") and len(self.worker.messages):
            last_message = self.worker.messages[-1].data["result"]
            print("Received {} total messages".format(len(self.worker.messages)))
            #for msg in self.worker.messages:
                 #print("Request #{}".format(msg))

        return (last_message, )
# ---------- end mqtt_subscriber ----------

dict_from_mesh = GhPythonScript(names=cluster.names_2, colors=cluster.colors_2, meshes=cluster.geometries_2, design_name=design_name)  # -> data; inputs names: list, colors: list of Color, meshes: list of Mesh
# ---------- dict_from_mesh: Python ----------
import Rhino.Geometry as rg
import System

data ={}
data["uid"] =design_name
data["elements"] ={}

i = 0
for mesh in meshes:
    if names is None or i >= len(names):
        name = "element"+ str(i)
    else:
        name = names[i]
        
    if colors is None or i >= len(colors):
        color = System.Drawing.Color.FromArgb(255, 255, 255, 255)
    else:
        color = colors[i]
        
#    data["priority"].append(name)
    data["elements"][name]={}
    data["elements"][name]["name"] = name
    data["elements"][name]["color"] = [color.R/255, color.G/255, color.B/255, color.A/255 ]
    
    list_faces =[]
    for f in mesh.Faces:
        face = [f[0], f[1], f[2]]
        list_faces.append(face)
    data["elements"][name]["faces"] = list_faces
    
    list_vertices =[]
    for v in mesh.Vertices:
        vertex=[v.X, v.Y, v.Z]
        list_vertices.append(vertex)
    data["elements"][name]["vertices"] = list_vertices
    
    list_normals =[]
    for n in mesh.Normals:
        normal=[n.X, n.Y, n.Z]
        list_normals.append(normal)
    data["elements"][name]["normals"] = list_normals
    
    list_uv =[]
    for u in mesh.TextureCoordinates:
        uv=[u.X, u.Y]
        list_uv.append(uv)
    data["elements"][name]["uv"] = list_uv
    
    i+=1
print (data["uid"])


data =[data]
# ---------- end dict_from_mesh ----------
value_list = ValueList({"String": 0, "Integer Number": 1, "Floating Point Number": 2, "Boolean Value": 3, "Dictionary": 4, "List": 5}, selected="Dictionary")
mqtt_publisher = MQTTPublisher(host=host_name, topic_name=ghpython_script_2.topicPublishGeos, msg=dict_from_mesh, msg_type=value_list, send=send_2)  # -> topic, is_advertised; inputs msg_type: Int32
# ---------- mqtt_publisher: Python ----------
#Publisher Imports
import ast
import time
import compas
import json
from ghpythonlib.componentbase import executingcomponent as component
from scriptcontext import sticky as st

from threading import Event

from compas_eve import Message
from compas_eve import Publisher
from compas_eve import Subscriber
from compas_eve import Topic
from compas_eve import set_default_transport
from compas_eve.mqtt import MqttTransport

from compas_ghpython import create_id

class MQTTTopicPublish(component):
    
    def RunScript(self, host, topic_name, msg, msg_type, send):
        # Check for required inputs
        if not host:
            raise ValueError('Please specify host')
        if not topic_name:
            raise ValueError('Please specify the name of the topic')
        
        # Create a unique key for storing the topic in sticky
        key = create_id(self, 'mqtt_topic'+ topic_name)
        topic = st.get(key, None)
        
        # Initialize MQTT transport with the specified host
        if host:
            tx = MqttTransport(host)
            # Create the topic if it doesn't exist
            if not topic:
                topic = Topic(topic_name, Message)
                time.sleep(0.2)
                st[key] = topic
                
        self.is_advertised = topic
        
        # If msg is None, check if the topic is advertised
        if msg is None:
            if self.is_advertised:
                self.Message = 'Topic advertised'
                
        else:
        # Handle different message types
            if send:
                message = self.convert_msg(msg, msg_type)
                
                # Encode the message and publish it
                message_encoded = Message(result=message)
                Publisher(topic, transport=tx).publish(message_encoded)
                self.Message = 'Message published'
            
        return topic, self.is_advertised
        
    def convert_msg(self, msg, msg_type):
        # Convert the message based on its type
        if msg_type == 0 or msg_type == 1 or msg_type == 2 or msg_type == 5:    # string, int, float, list
            return str(msg)
        elif msg_type == 3:  # bool
            return "True" if bool(msg) else "False"
        elif msg_type == 4:  # dict
            return compas.json_dumps(msg, False)
            #return ast.literal_eval(msg)
        else:
            print("other")
            return str(msg)
# ---------- end mqtt_publisher ----------

# ----
# 3. Define your Team's Name
value_list_2 = ValueList({"String": 0, "Integer Number": 1, "Floating Point Number": 2, "Boolean Value": 3, "Dictionary": 4, "List": 5}, selected="Dictionary")
mqtt_publisher_2 = MQTTPublisher(host=host_name, topic_name=ghpython_script_2.topicPublishLines, msg=dictionary, msg_type=value_list_2, send=send)  # -> topic, is_advertised; inputs msg_type: Int32; same code as mqtt_publisher

# ----
# Save a json file locally (extra)
# Notes: The json file will be saved in the HandTracking/data folder
save = Button()
to_json = ToJSON(data=dict_from_mesh, file_name=cluster.names_2, pretty=True, save=save)  # -> json; inputs pretty: Boolean
#   port data: COMPAS data objects to serialize.
#   port pretty: If True, JSON data will be formatted with indentation and key sorting.
#   port json: JSON file path or JSON string.
# ---------- to_json: Python ----------
"""
Serializes COMPAS objects to JSON.
"""

from ghpythonlib.componentbase import executingcomponent as component
import compas
import os
import Rhino

class CompasInfo(component):
    def RunScript(self, data, file_name, pretty, save):
        # Get the folder path of the current Grasshopper document
        gh_document = self.OnPingDocument()
        if gh_document is not None:
            base_folder = os.path.dirname(gh_document.FilePath)
        else:
            base_folder = ""
        
        # Define the relative path to the 'data' folder
        data_folder_relative_path = os.path.join("..", "data")
        data_folder_path = os.path.abspath(os.path.join(base_folder, data_folder_relative_path))
        
        # Create the 'data' folder if it does not exist
        if not os.path.exists(data_folder_path):
            os.makedirs(data_folder_path)
        
        # Construct the file path inside the 'data' folder
        filepath = os.path.join(data_folder_path, file_name + ".json")
        json = filepath
        if save:
            if filepath:
                compas.json_dump(data, filepath, pretty)
            else:
                json = compas.json_dumps(data, pretty)

        return json
# ---------- end to_json ----------

# ----
# Save a json file locally (extra)
# Notes: The json file will be saved in the HandTracking/data folder
save_2 = Button()
to_json_2 = ToJSON(data=dictionary, file_name="roof", pretty=True, save=save_2)  # -> json; inputs pretty: Boolean; same code as to_json

# ==== cluster ARMarker
ar_marker = Rectangle({Plane=PlaneXY(0.0375, -0.0375, 0), Size=Domain2(u=-0.0375..0.0375, v=-0.0375..0.0375)})
border = OffsetCurve(Curve=ar_marker, Distance="0.01", Corners=1)
geometry = Geometry([border, ar_marker])
ar_marker_2 = Geometry([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])
ar_marker_3 = ClusterOutput(ar_marker_2)

# ==== cluster Cluster
sif_pattern = Panel("""0
1
2""")
list = ClusterInput()
sift_pattern = SiftPattern(List=list, SiftPattern=sif_pattern)  # -> Output0, Output1, Output2
dispatch = Dispatch(List=list, DispatchPattern=[True, False])  # -> Geometries, ListB
index = ClusterInput()
colors = Data(sift_pattern.Output2)
geometries = Data(sift_pattern.Output0)
names = Data(sift_pattern.Output1)
create_dict = GhPythonScript(geometries=geometries, names=names, colors=colors, index=index)  # -> out, names, geometries, colors, geoDict; inputs geometries: list of Mesh, names: list, colors: list of Color, index: list of Int32
# ---------- create_dict: Python ----------
import Rhino.Geometry as rg

geom=[]
for geo in geometries:
    if geo !=None:
        geom.append(geo)


nms=[]
for name in names:
    if name !=None:
        nms.append(name)

clrs=[]
for color in colors:
    if color !=None:
        clrs.append(color)


geoDict ={}

for i, name in enumerate (nms):
    geoDict[name] = {}
    geoDict[name]["color"] = clrs[i]
    geoDict[name]["geometry"] = geom[i]

geoDict =[geoDict]
c =[]
n=[]
g=[]
for i in index:
    print i
    c.append(clrs[i])
    n.append(nms[i])
    g.append(geom[i])

names=n
colors=c
geometries=g

#color = colors[index]
#selectedName = names[index]
#geo = geometries[index]
# ---------- end create_dict ----------
geodict = ClusterOutput(create_dict.geoDict)
names_2 = ClusterOutput(create_dict.names)
geometries_2 = ClusterOutput(create_dict.geometries)
colors_2 = ClusterOutput(create_dict.colors)
